# Grasshopper definition inside.gh (Grasshopper 1.0.7)

number_slider = Slider(200, range=0..1000)
crv = Curve(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)
number_slider_2 = Slider(12, range=0..100)
pt = Point(Point(-1.178152495e-09, 250, 0))
divide = DivideCurve(Curve=crv, Count=number_slider_2, Kinks=False)  # -> Points, Tangents, Parameters
sph = Sphere(Base=pt, Radius=number_slider)
divide_2 = DivideCurve(Curve=crv, Count=number_slider_2, Kinks=False)  # -> Points, Tangents, Parameters
sph_2 = Sphere(Base=pt, Radius=number_slider)
divide_3 = DivideCurve(Curve=crv, Count=number_slider_2, Kinks=False)  # -> Points, Tangents, Parameters
sph_3 = Sphere(Base=pt, Radius=number_slider)
sph_4 = Sphere(Base=divide_3.Points, Radius=Slider(70, range=0..100))
shapein = ShapeInBrep(Brep=sph, Shape=divide.Points)
shapein_2 = ShapeInBrep(Brep=sph_2, Shape=divide_2.Points)
shapein_3 = ShapeInBrep(Brep=sph_3, Shape=sph_4)
cull = CullPattern(List=divide.Points, CullPattern=invert(shapein))
cull_2 = CullPattern(List=divide_2.Points, CullPattern=shapein_2)
expression = Expression(x=shapein_3, Expression="x-1")
cull_3 = CullPattern(List=sph_4, CullPattern=invert(expression))
