# Grasshopper definition partition_list.gh (Grasshopper 1.0.7)

xy = XYPlane(Origin=Point(0, 0, 0))
rad = Radians(Degrees=Slider(330, range=0..1000))
arc = Arc(Plane=xy, Radius=Slider(15, range=0..100), Angle=rad)  # -> Arc, Length
offset = OffsetCurve(Curve=arc.Arc, Distance=Slider(20, range=0..100), Corners=1)
loft = Loft(
    Curves=flatten([arc.Arc, offset]),
    Options={Adjust=False, Closed=False, LoftEnds=0, LoftSimp=0, LoftType=0, Rebuild=10, Refit=0.01})
number_slider = Slider(30, range=0..100)
number_slider_2 = Slider(3, range=0..10)
number_slider_3 = Slider(4, range=0..10)
addition = Addition(A=number_slider, B=number_slider_3)
divide = DivideDomain²(Domain=loft, UCount=number_slider_2, VCount=Slider(30, range=0..100))
number_slider_4 = Slider(1, range=0..10)
subsrf = Isotrim(Surface=loft, Domain=divide)
addition_2 = Addition(A=addition, B=number_slider_3)
lng = ListLength(List=subsrf)
division = Division(A=lng, B=number_slider_2)
dom = ConstructDomain(DomainStart=number_slider_4, DomainEnd=addition)
dom_2 = ConstructDomain(DomainStart=number_slider_4, DomainEnd=addition_2)
dom_3 = ConstructDomain(DomainStart=number_slider_4, DomainEnd=number_slider)
partition = PartitionList(List=subsrf, Size=division)
range = Range(Domain=[dom_3, dom, dom_2], Steps=expr("x-1", division))
Z = UnitZ(Factor=range)
extr = Extrude(Base=partition, Direction=Z)
