# Grasshopper definition path_mapper.gh (Grasshopper 1.0.7)

# ----
# Simplify
planesrf = PlaneSurface(Plane=PlaneXY(0, 0, 0), XSize=Domain(-10, 10), YSize=Domain(-10, 10))
sdivide = DivideSurface(Surface=planesrf, UCount=10, VCount=10)  # -> Points, Normals, Parameters
path_mapper = PathMapper(sdivide.Points, source="{A;B;C}", target="{C}")
simplify = SimplifyTree(Tree=sdivide.Points, Front=False)
viewer = ParamViewer(simplify)
viewer_2 = ParamViewer(path_mapper)
viewer_3 = ParamViewer(sdivide.Points)

# ----
# Flip Matrix
planesrf_2 = PlaneSurface(Plane=PlaneXY(0, 0, 0), XSize=Domain(-10, 10), YSize=Domain(-10, 10))
sdivide_2 = DivideSurface(Surface=planesrf_2, UCount=10, VCount=10)  # -> Points, Normals, Parameters
path_mapper_2 = PathMapper(sdivide_2.Points, source="{A;B;C}(i)", target="{A;B;i%item_count}")
flip = FlipMatrix(Data=sdivide_2.Points)
viewer_4 = ParamViewer(flip)
viewer_5 = ParamViewer(path_mapper_2)
viewer_6 = ParamViewer(sdivide_2.Points)

# ----
# Grouping
planesrf_3 = PlaneSurface(Plane=PlaneXY(0, 0, 0), XSize=Domain(-10, 10), YSize=Domain(-10, 10))
sdivide_3 = DivideSurface(Surface=planesrf_3, UCount=10, VCount=10)  # -> Points, Normals, Parameters
flatten = FlattenTree(Tree=sdivide_3.Points, Path="{0}")
path_mapper_3 = PathMapper(flatten, source="{A}(i)", target="{i\6}")
viewer_7 = ParamViewer(path_mapper_3)
viewer_8 = ParamViewer(flatten)

# ----
# Graft
planesrf_4 = PlaneSurface(Plane=PlaneXY(0, 0, 0), XSize=Domain(-10, 10), YSize=Domain(-10, 10))
sdivide_4 = DivideSurface(Surface=planesrf_4, UCount=10, VCount=10)  # -> Points, Normals, Parameters
path_mapper_4 = PathMapper(sdivide_4.Points, source="{A;B;C}(i)", target="{A;B;C;i}")
graft = GraftTree(Tree=sdivide_4.Points, IncludeEmptyLists=True, IncludeNullItems=True)
viewer_9 = ParamViewer(path_mapper_4)
viewer_10 = ParamViewer(sdivide_4.Points)
viewer_11 = ParamViewer(graft)

# ----
# Grouping by replacing branches
planesrf_5 = PlaneSurface(Plane=PlaneXY(0, 0, 0), XSize=Domain(-10, 10), YSize=Domain(-10, 10))
int = Integer(5)
addition = Addition(A=int, B="1")
sdivide_5 = DivideSurface(Surface=planesrf_5, UCount=10, VCount=int)  # -> Points, Normals, Parameters
flatten_2 = FlattenTree(Tree=sdivide_5.Points, Path="{0}")
lng = ListLength(List=flatten_2)
series = Series(Start=0, Step=1, Count=lng)
graft_2 = GraftTree(Tree=flatten_2, IncludeEmptyLists=True, IncludeNullItems=True)
simplify_2 = SimplifyTree(Tree=graft_2, Front=False)
eval = Evaluate(F="x\y", x=series, y=addition)
viewer_12 = ParamViewer(simplify_2)
replace = ReplacePaths(Data=simplify_2, Search=viewer_12, Replace=eval)
viewer_13 = ParamViewer(replace)
panel = Panel(viewer_12)
panel_2 = Panel(eval)

# ----
# Flatten
planesrf_6 = PlaneSurface(Plane=PlaneXY(0, 0, 0), XSize=Domain(-10, 10), YSize=Domain(-10, 10))
sdivide_6 = DivideSurface(Surface=planesrf_6, UCount=10, VCount=10)  # -> Points, Normals, Parameters
path_mapper_5 = PathMapper(sdivide_6.Points, source="{A;B;C}", target="{2}")
path_mapper_6 = PathMapper(sdivide_6.Points, source="{A;B;C}", target="{0}")
flatten_3 = FlattenTree(Tree=sdivide_6.Points, Path="2")
flatten_4 = FlattenTree(Tree=sdivide_6.Points, Path="{0}")
viewer_14 = ParamViewer(flatten_3)
viewer_15 = ParamViewer(sdivide_6.Points)
viewer_16 = ParamViewer(flatten_4)
viewer_17 = ParamViewer(path_mapper_6)
viewer_18 = ParamViewer(path_mapper_5)
