# Grasshopper definition tween_curve.gh (Grasshopper 1.0.7)

xy = XYPlane(Origin=Point(0, 0, 0))
rad = Radians(Degrees=Slider(180, range=0..1000))
number_slider = Slider(15, range=0..100)
number_slider_2 = Slider(3, range=0..10)
arc = Arc(Plane=xy, Radius=graft([Slider(3, range=0..10), Slider(7, range=0..10)]), Angle=rad)  # -> Arc, Length
bang = ExplodeTree(Data=arc.Arc)  # -> Branch0, Branch1
range = Range(Domain=Domain(0, 1), Steps=number_slider)
range_2 = Range(Domain=number_slider_2, Steps=number_slider)
lng = ListLength(List=range_2)
Z = UnitZ(Factor=range_2)
tweencrv = TweenCurve(CurveA=bang.Branch0, CurveB=bang.Branch1, Factor=range, BlendType=0)
division = Division(A=number_slider_2, B=lng)
move = Move(Geometry=tweencrv, Motion=Z)  # -> Geometry, Transform
Z_2 = UnitZ(Factor=division)
neg = Negative(Value=Z_2)
extr = Extrude(Base=move.Geometry, Direction=neg)
edges = BrepEdges(Brep=extr)  # -> Naked, Interior, NonManifold
item = ListItem(List=edges.Naked, Index=0, Wrap=True)  # -> Item, flatten(Item1), Item2, flatten(Item3)
shift = ShiftList(List=item.Item1, Shift=1, Wrap=invert(True))
flip = FlipCurve(Curve=item.Item3)  # -> Curve, Flag
cull_i = CullIndex(List=extr, Indices="4", Wrap=True)
merge = Merge(Data1=simplify(graft(shift)), Data2=simplify(graft(flip.Curve)))
loft = Loft(Curves=merge, Options={Adjust=False, Closed=False, LoftEnds=0, LoftSimp=0, LoftType=0, Rebuild=10, Refit=0.01})
join = BrepJoin(Breps=flatten([extr, loft]))  # -> Breps, Closed
