# Grasshopper definition radial_maelstrom.gh (Grasshopper 1.0.7)

xy = XYPlane(Origin=Point(0, 0, 0))
radgrid = Radial(Plane=xy, Size=1, ExtentR=Slider(10, range=0..100), ExtentP=Slider(25, range=0..100))  # -> Cells, Points
flip = FlipMatrix(Data=radgrid.Cells)
panel = Panel("""0
1""")
cull_i = CullIndex(List=flip, Indices=panel, Wrap=True)
maelstrom = Maelstrom(
    Geometry=cull_i,
    Plane=xy,
    First=Slider(0.5, range=0..1),
    Second=Slider(10, range=0..10),
    Angle=degrees(Slider(100, range=0..100)),
    Rigid=False)
