# Grasshopper definition replace.gh (Grasshopper 1.0.7)
# plug-ins: treesloth01

xz = XZPlane(Origin=Point(0, 0, 0))
planesrf = PlaneSurface(Plane=xz, XSize=Slider(40, range=0..100), YSize=Slider(20, range=0..100))
sdivide = DivideSurface(Surface=planesrf, UCount="2", VCount="2")  # -> Points, Normals, Parameters
shift = ShiftPaths(Data=sdivide.Points, Offset=-1)
Y = UnitY(Factor=Slider(4.25, range=0..10))
item = ListItem(List=shift, Index="4", Wrap=True)
neg = Negative(Value=Y)
move = Move(Geometry=item, Motion=neg)  # -> Geometry, Transform
replace = ReplaceItems(List=shift, Item=move.Geometry, Indices="4", Wrap=False)
srfgrid = SurfaceFromPoints(Points=replace, UCount=expr("x+1", "2"), Interpolate=Toggle(True))
