# Grasshopper definition altitude_map.gh (Grasshopper 1.0.7)

mesh = Mesh(<mesh referenced from the Rhino model>)
demesh = DeconstructMesh(Mesh=mesh)  # -> Vertices, Faces, Colours, Normals
pdecon = Deconstruct(Point=demesh.Vertices)  # -> XComponent, YComponent, ZComponent
devec = DeconstructVector(Vector=demesh.Normals)  # -> XComponent, YComponent, ZComponent

number_slider = Slider(13888, range=0..100000)
acos = ArcCosine(Value=devec.ZComponent)
number_slider_2 = Slider(2, range=0..100000)
item = ListItem(List=demesh.Vertices, Index=number_slider, Wrap=True)
item_2 = ListItem(List=demesh.Normals, Index=number_slider, Wrap=True)
deg = Degrees(Radians=acos)
line = LineSDL(Start=item, Direction=item_2, Length=number_slider_2)
panel = Panel(deg)
pipe = Pipe(Curve=line, Radius=number_slider_2, Caps=0)
cap = CapHoles(Brep=pipe)

bnd = Bounds(Numbers=pdecon.ZComponent)
gradient = Gradient(
    LowerLimit=0,
    UpperLimit=1,
    Parameter=devec.ZComponent,
    stops=[0.881: RGB(234, 38, 0), 0.949: RGB(234, 126, 0), 0.966: RGB(254, 244, 84), 0.984: RGB(173, 203, 249), 1: RGB(75, 107, 169)])
panel_2 = Panel("50")
dedomain = DeconstructDomain(Domain=bnd)  # -> Start, End
gradient_2 = Gradient(
    LowerLimit=dedomain.Start,
    UpperLimit=dedomain.End,
    Parameter=pdecon.ZComponent,
    stops=[0: RGB(205, 242, 211), 0.14: RGB(244, 255, 205), 0.276: RGB(120, 193, 114), 0.384: RGB(82, 166, 102), 0.512: RGB(232, 210, 97), 0.629: RGB(206, 123, 83), 0.757: RGB(158, 78, 70), 0.879: RGB(154, 114, 92), 1: RGB(200, 200, 200), 1: RGB(200, 200, 200), 1: RGB(200, 200, 200)])
panel_3 = Panel(dedomain.End)
panel_4 = Panel(dedomain.Start)
mcol = MeshColours(Mesh=mesh, Colours=gradient)
mcol_2 = MeshColours(Mesh=mesh, Colours=gradient_2)
