# Grasshopper definition heart_wall.gh (Grasshopper 1.0.7)
# plug-ins: LunchBox, Weaverbird, Shortest Walk in Gh

pt = Point(<point referenced from the Rhino model>)
pt_2 = Point(<point referenced from the Rhino model>)
pt_3 = Point(<point referenced from the Rhino model>)
crv = Curve(<curve referenced from the Rhino model>)
pt_4 = Point(<point referenced from the Rhino model>)
crv_2 = Curve([<curve referenced from the Rhino model> x3])
pt_5 = Point(<point referenced from the Rhino model>)
crv_3 = Curve(<curve referenced from the Rhino model>)
crv_4 = Curve([<curve referenced from the Rhino model> x4])
crv_5 = Curve(<curve referenced from the Rhino model>)
pt_6 = Point(<point referenced from the Rhino model>)
pt_7 = Point(<point referenced from the Rhino model>)
crv_6 = Curve(<curve referenced from the Rhino model>)
pt_8 = Point([<point referenced from the Rhino model> x2])
crv_7 = Curve(<curve referenced from the Rhino model>)
number_slider = Slider(6, range=0..10)
number_slider_2 = Slider(6, range=0..10)
pt_9 = Point(<point referenced from the Rhino model>)
crv_8 = Curve(<curve referenced from the Rhino model>)
crv_9 = Curve(<curve referenced from the Rhino model>)
pt_10 = Point(<point referenced from the Rhino model>)
pt_11 = Point(<point referenced from the Rhino model>)
crv_10 = Curve(<curve referenced from the Rhino model>)
number_slider_3 = Slider(6, range=0..10)
crv_11 = Curve(<curve referenced from the Rhino model>)
pt_12 = Point(<point referenced from the Rhino model>)
pt_13 = Point(<point referenced from the Rhino model>)
number_slider_4 = Slider(6, range=0..10)
crv_12 = Curve(<curve referenced from the Rhino model>)
crv_13 = Curve(<curve referenced from the Rhino model>)
number_slider_5 = Slider(6, range=0..10)
pt_14 = Point(<point referenced from the Rhino model>)
crv_14 = Curve(<curve referenced from the Rhino model>)
crv_15 = Curve(<curve referenced from the Rhino model>)
pt_15 = Point(<point referenced from the Rhino model>)
pt_16 = Point(<point referenced from the Rhino model>)
crv_16 = Curve(<curve referenced from the Rhino model>)
crv_17 = Curve(<curve referenced from the Rhino model>)
crv_18 = Curve(<curve referenced from the Rhino model>)
number_slider_6 = Slider(6, range=0..10)
number_slider_7 = Slider(8, range=0..10)
loft = Loft(Curves=crv_4, Options={Adjust=False, Closed=False, LoftEnds=0, LoftSimp=0, LoftType=0, Rebuild=10, Refit=0.01})
number_slider_8 = Slider(6, range=0..10)
series = Series(Start=0, Step=Slider(0.009, range=0..0.1), Count=Slider(120, range=0..1000))
series_2 = Series(Start=0, Step=Slider(0.009, range=0..0.1), Count=Slider(120, range=0..1000))
range = Range(Domain=Domain(0, 1), Steps=number_slider)
sqgrid = Square(Plane=pt, Size=Slider(100, range=0..1000), ExtentX=Slider(15, range=0..100), ExtentY=Slider(15, range=0..100))  # -> Cells, flatten(Points)
range_2 = Range(Domain=Domain(0, 1), Steps=number_slider_2)
dam = DataDam(DataA=loft, BufferDelay=20000000, BufferMode=2)
series_3 = Series(Start=0, Step=Slider(0.009, range=0..0.1), Count=Slider(120, range=0..1000))
range_3 = Range(Domain=Domain(0, 1), Steps=number_slider_3)
series_4 = Series(Start=0, Step=Slider(0.009, range=0..0.1), Count=Slider(120, range=0..1000))
sqgrid_2 = Square(Plane=pt_3, Size=Slider(100, range=0..1000), ExtentX=Slider(15, range=0..100), ExtentY=Slider(15, range=0..100))  # -> Cells, flatten(Points)
range_4 = Range(Domain=Domain(0, 1), Steps=number_slider_4)
series_5 = Series(Start=0, Step=Slider(0.009, range=0..0.1), Count=Slider(120, range=0..1000))
series_6 = Series(Start=0, Step=Slider(0.01, range=0..0.1), Count=Slider(101, range=0..1000))
range_5 = Range(Domain=Domain(0, 1), Steps=number_slider_5)
number_slider_9 = Slider(15, range=0..100)
series_7 = Series(Start=0, Step=Slider(0.009, range=0..0.1), Count=Slider(120, range=0..1000))
range_6 = Range(Domain=Domain(0, 1), Steps=number_slider_6)
range_7 = Range(Domain=Domain(0, 1), Steps=number_slider_7)
range_8 = Range(Domain=Domain(0, 1), Steps=number_slider_8)
tweencrv = TweenCurve(CurveA=crv_5, CurveB=crv_3, Factor=range, BlendType=0)
tweencrv_2 = TweenCurve(CurveA=crv_7, CurveB=crv_6, Factor=range_2, BlendType=0)

toggle = BooleanToggle(False)
series_8 = Series(Start=0, Step=expr("x+1", number_slider), Count=Slider(17, range=0..100))
addition = Addition(A=series_8, B="-1")
panel = Panel(series_8)
path_mapper = PathMapper(source="{A;B} (i)", target="{i\6}")
shift = ShiftList(List=series_8, Shift="-1", Wrap=toggle)
shift_2 = ShiftList(List=addition, Shift=1, Wrap=toggle)
panel_2 = Panel(shift_2)
panel_3 = Panel(shift)
dom = ConstructDomain(DomainStart=shift, DomainEnd=shift_2)
panel_4 = Panel(dom)
subset = SubList(List=series, Domain=dom, Wrap=Toggle(False))  # -> List, Index
panel_5 = Panel(subset.List)

toggle_2 = BooleanToggle(False)
series_9 = Series(Start=0, Step=expr("x+1", number_slider_2), Count=Slider(17, range=0..100))
addition_2 = Addition(A=series_9, B="-1")
panel_6 = Panel(series_9)
path_mapper_2 = PathMapper(source="{A;B} (i)", target="{i\6}")
shift_3 = ShiftList(List=series_9, Shift="-1", Wrap=toggle_2)
shift_4 = ShiftList(List=addition_2, Shift=1, Wrap=toggle_2)
panel_7 = Panel(shift_4)
panel_8 = Panel(shift_3)
dom_2 = ConstructDomain(DomainStart=shift_3, DomainEnd=shift_4)
panel_9 = Panel(dom_2)
subset_2 = SubList(List=series_2, Domain=dom_2, Wrap=Toggle(False))  # -> List, Index
panel_10 = Panel(subset_2.List)

panel_11 = Panel(range)
tweencrv_3 = TweenCurve(CurveA=crv_9, CurveB=crv_8, Factor=range_3, BlendType=0)
panel_12 = Panel(range_2)
tweencrv_4 = TweenCurve(CurveA=crv_11, CurveB=crv_10, Factor=range_4, BlendType=0)
slider = Slider(100, range=0..100)
tweencrv_5 = TweenCurve(CurveA=crv_13, CurveB=crv_12, Factor=range_5, BlendType=0)
loft_2 = Loft(Curves=crv_2, Options={Adjust=False, Closed=False, LoftEnds=0, LoftSimp=0, LoftType=0, Rebuild=10, Refit=0.01})

toggle_3 = BooleanToggle(False)
series_10 = Series(Start=0, Step=expr("x+1", number_slider_3), Count=Slider(17, range=0..100))
addition_3 = Addition(A=series_10, B="-1")
panel_13 = Panel(series_10)
path_mapper_3 = PathMapper(source="{A;B} (i)", target="{i\6}")
shift_5 = ShiftList(List=series_10, Shift="-1", Wrap=toggle_3)
shift_6 = ShiftList(List=addition_3, Shift=1, Wrap=toggle_3)
panel_14 = Panel(shift_6)
panel_15 = Panel(shift_5)
dom_3 = ConstructDomain(DomainStart=shift_5, DomainEnd=shift_6)
panel_16 = Panel(dom_3)
subset_3 = SubList(List=series_3, Domain=dom_3, Wrap=Toggle(False))  # -> List, Index
panel_17 = Panel(subset_3.List)

dist = Distance(PointA=sqgrid.Points, PointB=pt_2)
panel_18 = Panel(range_3)

toggle_4 = BooleanToggle(False)
series_11 = Series(Start=0, Step=expr("x+1", number_slider_4), Count=Slider(17, range=0..100))
addition_4 = Addition(A=series_11, B="-1")
panel_19 = Panel(series_11)
path_mapper_4 = PathMapper(source="{A;B} (i)", target="{i\6}")
shift_7 = ShiftList(List=series_11, Shift="-1", Wrap=toggle_4)
shift_8 = ShiftList(List=addition_4, Shift=1, Wrap=toggle_4)
panel_20 = Panel(shift_8)
panel_21 = Panel(shift_7)
dom_4 = ConstructDomain(DomainStart=shift_7, DomainEnd=shift_8)
panel_22 = Panel(dom_4)
subset_4 = SubList(List=series_4, Domain=dom_4, Wrap=Toggle(False))  # -> List, Index
panel_23 = Panel(subset_4.List)

panel_24 = Panel(range_4)

toggle_5 = BooleanToggle(False)
series_12 = Series(Start=0, Step=expr("x+1", number_slider_5), Count=Slider(17, range=0..100))
addition_5 = Addition(A=series_12, B="-1")
panel_25 = Panel(series_12)
path_mapper_5 = PathMapper(source="{A;B} (i)", target="{i\6}")
shift_9 = ShiftList(List=series_12, Shift="-1", Wrap=toggle_5)
shift_10 = ShiftList(List=addition_5, Shift=1, Wrap=toggle_5)
panel_26 = Panel(shift_10)
panel_27 = Panel(shift_9)
dom_5 = ConstructDomain(DomainStart=shift_9, DomainEnd=shift_10)
panel_28 = Panel(dom_5)
subset_5 = SubList(List=series_5, Domain=dom_5, Wrap=Toggle(False))  # -> List, Index
panel_29 = Panel(subset_5.List)

incurve = PointInCurve(Point=sqgrid_2.Points, Curve=crv)  # -> Relationship, Point
tweencrv_6 = TweenCurve(CurveA=crv_16, CurveB=crv_17, Factor=range_6, BlendType=0)
tweencrv_7 = TweenCurve(CurveA=crv_15, CurveB=crv_14, Factor=range_7, BlendType=0)
panel_30 = Panel(range_5)
tweencrv_8 = TweenCurve(CurveA=crv_18, CurveB=crv_17, Factor=range_8, BlendType=0)

toggle_6 = BooleanToggle(False)
series_13 = Series(Start=0, Step=expr("x+1", number_slider_6), Count=Slider(17, range=0..100))
addition_6 = Addition(A=series_13, B="-1")
panel_31 = Panel(series_13)
path_mapper_6 = PathMapper(source="{A;B} (i)", target="{i\6}")
shift_11 = ShiftList(List=series_13, Shift="-1", Wrap=toggle_6)
shift_12 = ShiftList(List=addition_6, Shift=1, Wrap=toggle_6)
panel_32 = Panel(shift_12)
panel_33 = Panel(shift_11)
dom_6 = ConstructDomain(DomainStart=shift_11, DomainEnd=shift_12)
panel_34 = Panel(dom_6)
subset_6 = SubList(List=series_6, Domain=dom_6, Wrap=Toggle(False))  # -> List, Index
panel_35 = Panel(subset_6.List)

toggle_7 = BooleanToggle(False)
series_14 = Series(Start=0, Step=expr("x+1", number_slider_7), Count=Slider(13, range=0..100))
addition_7 = Addition(A=series_14, B="-1")
panel_36 = Panel(series_14)
path_mapper_7 = PathMapper(source="{A;B} (i)", target="{i\6}")
shift_13 = ShiftList(List=series_14, Shift="-1", Wrap=toggle_7)
shift_14 = ShiftList(List=addition_7, Shift=1, Wrap=toggle_7)
panel_37 = Panel(shift_14)
panel_38 = Panel(shift_13)
dom_7 = ConstructDomain(DomainStart=shift_13, DomainEnd=shift_14)
panel_39 = Panel(dom_7)
subset_7 = SubList(List=series_7, Domain=dom_7, Wrap=Toggle(False))  # -> List, Index
panel_40 = Panel(subset_7.List)

toggle_8 = BooleanToggle(False)
series_15 = Series(Start=0, Step=expr("x+1", number_slider_8), Count=Slider(17, range=0..100))
addition_8 = Addition(A=series_15, B="-1")
panel_41 = Panel(series_15)
path_mapper_8 = PathMapper(source="{A;B} (i)", target="{i\6}")
shift_15 = ShiftList(List=series_15, Shift="-1", Wrap=toggle_8)
shift_16 = ShiftList(List=addition_8, Shift=1, Wrap=toggle_8)
panel_42 = Panel(shift_16)
panel_43 = Panel(shift_15)
dom_8 = ConstructDomain(DomainStart=shift_15, DomainEnd=shift_16)
panel_44 = Panel(dom_8)
subset_8 = SubList(List=series_6, Domain=dom_8, Wrap=Toggle(False))  # -> List, Index
panel_45 = Panel(subset_8.List)

panel_46 = Panel(range_6)
panel_47 = Panel(range_7)
panel_48 = Panel(range_8)
bnd = Bounds(Numbers=dist)
hex = HexagonCells(Surface=dam, UDivisions=number_slider_9, VDivisions=number_slider_9, TParameter=Slider(0.25, range=0..1))  # -> HexagonCells, Centers
dispatch = Dispatch(List=sqgrid_2.Points, DispatchPattern=incurve.Relationship)  # -> ListA, ListB
remap = RemapNumbers(Value=dist, Source=bnd, Target=Domain(0, 1))  # -> Mapped, Clipped
sdivide = DivideSurface(Surface=loft_2, UCount=slider, VCount=slider)  # -> flatten(Points), Normals, Parameters
dist_2 = Distance(PointA=dispatch.ListA, PointB=pt_4)
graph = GraphMapper(remap.Mapped, x0=0, x1=1, y0=0, y1=1, container_name="Bezier", cpx=[0, 0, 0.5028942823, 1], cpy=[0, 0.1945522428, 1, 1])
bnd_2 = Bounds(Numbers=dist_2)
project = Project(Curve=hex.HexagonCells, Brep=loft, Direction=Vector(0, 0, 1))  # -> flatten(Curve)
xy = XYPlane(Origin=dispatch.ListA)
ln = Line(StartPoint=pt_4, EndPoint=dispatch.ListA)
remap_2 = RemapNumbers(Value=dist_2, Source=bnd_2, Target=Domain(0, 1))  # -> Mapped, Clipped
dom_9 = ConstructDomain(DomainStart=Slider(400, range=0..1000), DomainEnd=Slider(100, range=0..1000))
srfsplit = SurfaceSplit(Surface=loft, Curves=project)
align = AlignPlane(Plane=xy, Direction=ln)  # -> Plane, Angle
graph_2 = GraphMapper(
    remap_2.Mapped,
    x0=0,
    x1=1,
    y0=0,
    y1=1,
    container_name="Bezier",
    cpx=[0, 0, 0.5028942823, 1],
    cpy=[0, 0.1945522428, 1, 1])
remap_3 = RemapNumbers(Value=graph, Source=Domain(0, 1), Target=dom_9)  # -> Mapped, Clipped
graph_3 = GraphMapper(
    remap_2.Mapped,
    x0=0,
    x1=1,
    y0=0,
    y1=1,
    container_name="Bezier",
    cpx=[0, 0.1924357712, 0.5028942823, 1],
    cpy=[0, 0.3993132114, 1, 1])
graph_4 = GraphMapper(
    remap_2.Mapped,
    x0=0,
    x1=1,
    y0=0,
    y1=1,
    container_name="Bezier",
    cpx=[0, 0, 0.08953318745, 1],
    cpy=[0, 0.8946374059, 1, 1])
pt_17 = Point(<point referenced from the Rhino model>)
dist_3 = Distance(PointA=pt_5, PointB=graft(sdivide.Points))  # -> simplify(Distance)
dist_4 = Distance(PointA=pt_8, PointB=graft(sdivide.Points))  # -> simplify(Distance)
dom_10 = ConstructDomain(DomainStart=Slider(400, range=0..1000), DomainEnd=Slider(100, range=0..1000))
dom_11 = ConstructDomain(DomainStart=Slider(0, range=0..1000), DomainEnd=Slider(60, range=0..1000))
dom_12 = ConstructDomain(DomainStart=Slider(0, range=0..1000), DomainEnd=Slider(45, range=0..1000))
bnd_3 = Bounds(Numbers=flatten(dist_3))
bnd_4 = Bounds(Numbers=flatten(dist_4))
remap_4 = RemapNumbers(Value=graph_2, Source=Domain(0, 1), Target=dom_10)  # -> Mapped, Clipped
area = Area(Geometry=srfsplit)  # -> Area, flatten(Centroid)
remap_5 = RemapNumbers(Value=graph_3, Source=Domain(0, 1), Target=dom_11)  # -> Mapped, Clipped
remap_6 = RemapNumbers(Value=graph_4, Source=Domain(0, 1), Target=dom_12)  # -> Mapped, Clipped
remap_7 = RemapNumbers(Value=dist_3, Source=bnd_3, Target=Domain(0, 1))  # -> Mapped, Clipped
remap_8 = RemapNumbers(Value=dist_4, Source=bnd_4, Target=Domain(0, 1))  # -> Mapped, Clipped
debrep = DeconstructBrep(Brep=srfsplit)  # -> Faces, Edges, Vertices
graph_5 = GraphMapper(
    remap_7.Mapped,
    x0=0,
    x1=1,
    y0=0,
    y1=1,
    container_name="Sinc",
    Equation_X0=0,
    Equation_X1=0.06394027919,
    Equation_Y0=0.6041887999,
    Equation_Y1=0.5340523124)
graph_6 = GraphMapper(
    remap_8.Mapped,
    x0=0,
    x1=1,
    y0=0,
    y1=1,
    container_name="Sinc",
    Equation_X0=0,
    Equation_X1=0.02757300436,
    Equation_Y0=0.6041887999,
    Equation_Y1=0.5446140766)
box = CenterBox(Base=sqgrid.Points, X=Slider(25, range=0..100), Y=Slider(25, range=0..100), Z=remap_3.Mapped)
Z = UnitZ(Factor=remap_4.Mapped)
join = JoinCurves(Curves=debrep.Edges, Preserve=False)  # -> flatten(Curves)
dist_5 = Distance(PointA=area.Centroid, PointB=pt_17)
panel_49 = Panel(box)
move = Move(Geometry=dispatch.ListA, Motion=Z)  # -> Geometry, Transform
bnd_5 = Bounds(Numbers=dist_5)
box_2 = CenterBox(Base=align.Plane, X=Slider(25, range=0..100), Y=Slider(25, range=0..100), Z=remap_4.Mapped)
ma = MassAddition(Input=[graph_5, graph_6])  # -> flatten(Result), PartialResults
remap_9 = RemapNumbers(Value=dist_5, Source=bnd_5, Target=Domain(0, 1))  # -> Mapped, Clipped
ln_2 = Line(StartPoint=dispatch.ListA, EndPoint=move.Geometry)
dam_2 = DataDam(DataA=ma.Result, BufferDelay=20000000, BufferMode=2)
wave_height = Slider(75, range=0..1000)
graph_7 = GraphMapper(
    remap_9.Mapped,
    x0=0,
    x1=1,
    y0=0,
    y1=1,
    container_name="Bezier",
    cpx=[0, 0.1743612885, 0, 1],
    cpy=[0, 0.4086100459, 1, 1])
eval = EvaluateCurve(Curve=reparameterize(tweencrv), Parameter=subset.List)  # -> flatten(Point), flatten(Tangent), Angle
graph_8 = GraphMapper(
    remap_9.Mapped,
    x0=0,
    x1=1,
    y0=0,
    y1=1,
    container_name="Bezier",
    cpx=[0, 0.1924357712, 0.5028942823, 1],
    cpy=[0, 0.3993132114, 1, 1])
eval_2 = EvaluateCurve(Curve=reparameterize(tweencrv_2), Parameter=subset_2.List)  # -> flatten(Point), flatten(Tangent), Angle
pl = ConstructPlane(Origin=dispatch.ListA, XAxis=ln_2, YAxis=ln)
dist_6 = Distance(PointA=area.Centroid, PointB=pt_17)
ln_3 = Line(StartPoint=pt_17, EndPoint=area.Centroid)
eval_3 = EvaluateCurve(Curve=reparameterize(tweencrv_3), Parameter=subset_3.List)  # -> flatten(Point), flatten(Tangent), Angle
dom_13 = ConstructDomain(DomainStart=Slider(300, range=0..1000), DomainEnd=Slider(100, range=0..1000))
eval_4 = EvaluateCurve(Curve=reparameterize(tweencrv_4), Parameter=subset_4.List)  # -> flatten(Point), flatten(Tangent), Angle
bnd_6 = Bounds(Numbers=flatten(dam_2))
eval_5 = EvaluateCurve(Curve=reparameterize(tweencrv_5), Parameter=subset_5.List)  # -> flatten(Point), flatten(Tangent), Angle
eval_6 = EvaluateCurve(Curve=reparameterize(tweencrv_7), Parameter=subset_7.List)  # -> flatten(Point), flatten(Tangent), Angle
eval_7 = EvaluateCurve(Curve=reparameterize(tweencrv_6), Parameter=subset_6.List)  # -> flatten(Point), flatten(Tangent), Angle
eval_8 = EvaluateCurve(Curve=reparameterize(tweencrv_8), Parameter=subset_8.List)  # -> flatten(Point), flatten(Tangent), Angle
remap_10 = RemapNumbers(Value=dam_2, Source=bnd_6, Target=wave_height)  # -> Mapped, Clipped
rotate = Rotate(Geometry=box_2, Angle=degrees(remap_5.Mapped), Plane=pl)  # -> Geometry, Transform
dom_14 = ConstructDomain(DomainStart=Slider(0, range=0..1000), DomainEnd=Slider(60, range=0..1000))
remap_11 = RemapNumbers(Value=graph_7, Source=Domain(0, 1), Target=dom_13)  # -> Mapped, Clipped
ln_4 = Line(StartPoint=pt_6, EndPoint=eval.Point)
ln_5 = Line(StartPoint=pt_6, EndPoint=eval_2.Point)
dist_7 = Distance(PointA=eval.Point, PointB=pt_7)
dist_8 = Distance(PointA=eval_2.Point, PointB=pt_7)
line = LineSDL(Start=eval.Point, Direction=eval.Tangent, Length=Slider(50, range=0..100))
line_2 = LineSDL(Start=eval_3.Point, Direction=eval_3.Tangent, Length=Slider(50, range=0..100))
line_3 = LineSDL(Start=eval_2.Point, Direction=eval_2.Tangent, Length=Slider(50, range=0..100))
ln_6 = Line(StartPoint=pt_10, EndPoint=eval_4.Point)
remap_12 = RemapNumbers(Value=graph_8, Source=Domain(0, 1), Target=dom_14)  # -> Mapped, Clipped
xy_2 = XYPlane(Origin=area.Centroid)
ln_7 = Line(StartPoint=pt_12, EndPoint=eval_5.Point)
dist_9 = Distance(PointA=eval_4.Point, PointB=pt_11)
line_4 = LineSDL(Start=eval_4.Point, Direction=eval_4.Tangent, Length=Slider(50, range=0..100))
dist_10 = Distance(PointA=eval_5.Point, PointB=pt_13)
line_5 = LineSDL(Start=eval_6.Point, Direction=eval_6.Tangent, Length=Slider(50, range=0..100))
line_6 = LineSDL(Start=area.Centroid, Direction=Vector(0, 0, 1), Length=remap_11.Mapped)
line_7 = LineSDL(Start=eval_5.Point, Direction=eval_5.Tangent, Length=Slider(50, range=0..100))
Z_2 = UnitZ(Factor=remap_10.Mapped)
align_2 = AlignPlane(Plane=xy_2, Direction=ln_3)  # -> Plane, Angle
rotate_2 = Rotate(Geometry=rotate.Geometry, Angle=degrees(remap_6.Mapped), Plane=align.Plane)  # -> Geometry, Transform
dist_11 = Distance(PointA=eval_3.Point, PointB=pt_9)
bnd_7 = Bounds(Numbers=dist_7)
bnd_8 = Bounds(Numbers=dist_8)
move_2 = Move(Geometry=sdivide.Points, Motion=Z_2)  # -> Geometry, Transform
bnd_9 = Bounds(Numbers=dist_9)
dist_12 = Distance(PointA=eval_6.Point, PointB=pt_14)
bnd_10 = Bounds(Numbers=dist_10)
pl_2 = PlaneNormal(Origin=eval.Point, ZAxis=ln_4)
pl_3 = PlaneNormal(Origin=eval_2.Point, ZAxis=ln_5)
panel_50 = Panel(rotate_2.Geometry)
remap_13 = RemapNumbers(Value=dist_7, Source=bnd_7, Target=Domain(0, 1))  # -> Mapped, Clipped
remap_14 = RemapNumbers(Value=dist_8, Source=bnd_8, Target=Domain(0, 1))  # -> Mapped, Clipped
pl_4 = PlaneNormal(Origin=eval_4.Point, ZAxis=ln_6)
bnd_11 = Bounds(Numbers=dist_11)
bnd_12 = Bounds(Numbers=dist_11)
pl_5 = PlaneNormal(Origin=eval_5.Point, ZAxis=ln_7)
srfgrid = SurfaceFromPoints(Points=move_2.Geometry, UCount=expr("x+1", slider), Interpolate=False)
remap_15 = RemapNumbers(Value=dist_9, Source=bnd_9, Target=Domain(0, 1))  # -> Mapped, Clipped
rotate_3 = Rotate(Geometry=line_2, Angle=Slider(1.5, range=0..10), Plane=eval_3.Point)  # -> Geometry, Transform
remap_16 = RemapNumbers(Value=dist_10, Source=bnd_10, Target=Domain(0, 1))  # -> Mapped, Clipped
bnd_13 = Bounds(Numbers=dist_12)
bnd_14 = Bounds(Numbers=dist_12)
pl_6 = ConstructPlane(Origin=area.Centroid, XAxis=line_6, YAxis=ln_3)
graph_9 = GraphMapper(
    remap_13.Mapped,
    x0=0,
    x1=1,
    y0=0,
    y1=1,
    container_name="Bezier",
    cpx=[0, 0, 1, 1],
    cpy=[0, 0.4894984365, 0.4974666238, 1])
rotate_4 = Rotate(Geometry=line_5, Angle=Slider(1.5, range=0..10), Plane=eval_6.Point)  # -> Geometry, Transform
graph_10 = GraphMapper(
    remap_14.Mapped,
    x0=0,
    x1=1,
    y0=0,
    y1=1,
    container_name="Bezier",
    cpx=[0, 0, 1, 1],
    cpy=[0, 0.4894984365, 0.4974666238, 1])
graph_11 = GraphMapper(
    remap_13.Mapped,
    x0=0,
    x1=1,
    y0=0,
    y1=1,
    container_name="Bezier",
    cpx=[0, 0.5093007088, 0.4941172898, 1],
    cpy=[0, 0, 1, 1])
graph_12 = GraphMapper(
    remap_14.Mapped,
    x0=0,
    x1=1,
    y0=0,
    y1=1,
    container_name="Bezier",
    cpx=[0, 0.5093007088, 0.4941172898, 1],
    cpy=[0, 0, 1, 1])
remap_17 = RemapNumbers(Value=dist_11, Source=bnd_11, Target=Domain(0, 1))  # -> Mapped, Clipped
remap_18 = RemapNumbers(Value=dist_11, Source=bnd_12, Target=Domain(0, 1))  # -> Mapped, Clipped
graph_13 = GraphMapper(
    remap_15.Mapped,
    x0=0,
    x1=1,
    y0=0,
    y1=1,
    container_name="Bezier",
    cpx=[0, 0, 1, 1],
    cpy=[0, 0.4974666238, 0.4974666238, 1])
dam_3 = DataDam(DataA=srfgrid, BufferDelay=20000000, BufferMode=2)
graph_14 = GraphMapper(
    remap_16.Mapped,
    x0=0,
    x1=1,
    y0=0,
    y1=1,
    container_name="Bezier",
    cpx=[0, 0, 1, 1],
    cpy=[0, 0.4894984365, 0.4974666238, 1])
pl_7 = ConstructPlane(Origin=eval_3.Point, XAxis=line_2, YAxis=rotate_3.Geometry)
graph_15 = GraphMapper(
    remap_16.Mapped,
    x0=0,
    x1=1,
    y0=0,
    y1=1,
    container_name="Bezier",
    cpx=[0, 0.5093007088, 0.4941172898, 1],
    cpy=[0, 0, 1, 1])
remap_19 = RemapNumbers(Value=dist_12, Source=bnd_13, Target=Domain(0, 1))  # -> Mapped, Clipped
remap_20 = RemapNumbers(Value=dist_12, Source=bnd_14, Target=Domain(0, 1))  # -> Mapped, Clipped
number_slider_10 = Slider(15, range=0..100)
pl_8 = ConstructPlane(Origin=eval_6.Point, XAxis=line_5, YAxis=rotate_4.Geometry)
graph_16 = GraphMapper(
    remap_17.Mapped,
    x0=0,
    x1=1,
    y0=0,
    y1=1,
    container_name="Bezier",
    cpx=[0, 0, 0.5028942823, 1],
    cpy=[0, 0.1945522428, 1, 1])
graph_17 = GraphMapper(
    remap_18.Mapped,
    x0=0,
    x1=1,
    y0=0,
    y1=1,
    container_name="Bezier",
    cpx=[0, 0.5029619932, 0.5007432103, 1],
    cpy=[0, 0, 1, 1])
rotate_5 = Rotate(Geometry=line_6, Angle=degrees(remap_12.Mapped), Plane=pl_6)  # -> Geometry, Transform
dom_15 = ConstructDomain(DomainStart=Slider(400, range=0..1000), DomainEnd=Slider(100, range=0..1000))
dom_16 = ConstructDomain(DomainStart=Slider(400, range=0..1000), DomainEnd=Slider(100, range=0..1000))
dom_17 = ConstructDomain(DomainStart=Slider(0, range=0..1000), DomainEnd=Slider(70, range=0..1000))
graph_18 = GraphMapper(
    remap_19.Mapped,
    x0=0,
    x1=1,
    y0=0,
    y1=1,
    container_name="Bezier",
    cpx=[0, 0, 0.5028942823, 1],
    cpy=[0, 0.1945522428, 1, 1])
pt_18 = Point(flatten([eval_8.Point, eval_7.Point]))
graph_19 = GraphMapper(
    remap_20.Mapped,
    x0=0,
    x1=1,
    y0=0,
    y1=1,
    container_name="Bezier",
    cpx=[0, 0.5029619932, 0.5007432103, 1],
    cpy=[0, 0, 1, 1])
vec = Vector(flatten([eval_8.Tangent, eval_7.Tangent]))
dom_18 = ConstructDomain(DomainStart=Slider(0, range=0..1000), DomainEnd=Slider(70, range=0..1000))
dom_19 = ConstructDomain(DomainStart=Slider(400, range=0..1000), DomainEnd=Slider(100, range=0..1000))
dom_20 = ConstructDomain(DomainStart=Slider(400, range=0..1000), DomainEnd=Slider(100, range=0..1000))
dom_21 = ConstructDomain(DomainStart=Slider(0, range=0..1000), DomainEnd=Slider(70, range=0..1000))
bnd_15 = Bounds(Numbers=dist_6)
dom_22 = ConstructDomain(DomainStart=Slider(0.5, range=0.01..1), DomainEnd=Slider(0.01, range=0.01..1))
number_slider_11 = Slider(25, range=0..100)
remap_21 = RemapNumbers(Value=graph_9, Source=Domain(0, 1), Target=dom_15)  # -> Mapped, Clipped
number_slider_12 = Slider(25, range=0..100)
remap_22 = RemapNumbers(Value=graph_10, Source=Domain(0, 1), Target=dom_16)  # -> Mapped, Clipped
end = EndPoints(Curve=rotate_5.Geometry)  # -> Start, End
dom_23 = ConstructDomain(DomainStart=Slider(400, range=0..1000), DomainEnd=Slider(100, range=0..1000))
dom_24 = ConstructDomain(DomainStart=Slider(0, range=0..1000), DomainEnd=Slider(60, range=0..1000))
remap_23 = RemapNumbers(Value=graph_11, Source=Domain(0, 1), Target=dom_17)  # -> Mapped, Clipped
number_slider_13 = Slider(25, range=0..100)
remap_24 = RemapNumbers(Value=graph_12, Source=Domain(0, 1), Target=dom_18)  # -> Mapped, Clipped
remap_25 = RemapNumbers(Value=graph_13, Source=Domain(0, 1), Target=dom_19)  # -> Mapped, Clipped
number_slider_14 = Slider(25, range=0..100)
remap_26 = RemapNumbers(Value=graph_14, Source=Domain(0, 1), Target=dom_20)  # -> Mapped, Clipped
hex_2 = HexagonCells(Surface=dam_3, UDivisions=number_slider_10, VDivisions=number_slider_10, TParameter=Slider(0.25, range=0..1))  # -> HexagonCells, Centers
dom_25 = ConstructDomain(DomainStart=Slider(400, range=0..1000), DomainEnd=Slider(100, range=0..1000))
dom_26 = ConstructDomain(DomainStart=Slider(0, range=0..1000), DomainEnd=Slider(60, range=0..1000))
remap_27 = RemapNumbers(Value=graph_15, Source=Domain(0, 1), Target=dom_21)  # -> Mapped, Clipped
ln_8 = Line(StartPoint=pt_15, EndPoint=pt_18)
vec2pt = Vector2Pt(PointA=end.Start, PointB=end.End, Unitize=False)  # -> Vector, Length
remap_28 = RemapNumbers(Value=dist_6, Source=bnd_15, Target=dom_22)  # -> Mapped, Clipped
dist_13 = Distance(PointA=pt_18, PointB=pt_16)
line_8 = LineSDL(Start=pt_18, Direction=vec, Length=Slider(50, range=0..100))
remap_29 = RemapNumbers(Value=graph_16, Source=Domain(0, 1), Target=dom_23)  # -> Mapped, Clipped
remap_30 = RemapNumbers(Value=graph_17, Source=Domain(0, 1), Target=dom_24)  # -> Mapped, Clipped
remap_31 = RemapNumbers(Value=graph_18, Source=Domain(0, 1), Target=dom_25)  # -> Mapped, Clipped
remap_32 = RemapNumbers(Value=graph_19, Source=Domain(0, 1), Target=dom_26)  # -> Mapped, Clipped
box_3 = CenterBox(Base=pl_2, X=number_slider_11, Y=number_slider_11, Z=remap_21.Mapped)
box_4 = CenterBox(Base=pl_3, X=number_slider_12, Y=number_slider_12, Z=remap_22.Mapped)
move_3 = Move(Geometry=join, Motion=vec2pt.Vector)  # -> Geometry, Transform
move_4 = Move(Geometry=srfsplit, Motion=vec2pt.Vector)  # -> Geometry, Transform
box_5 = CenterBox(Base=pl_7, X=Slider(25, range=0..100), Y=Slider(25, range=0..100), Z=remap_29.Mapped)
box_6 = CenterBox(Base=pl_4, X=number_slider_13, Y=number_slider_13, Z=remap_25.Mapped)
bnd_16 = Bounds(Numbers=dist_13)
box_7 = CenterBox(Base=pl_5, X=number_slider_14, Y=number_slider_14, Z=remap_26.Mapped)
box_8 = CenterBox(Base=pl_8, X=Slider(25, range=0..100), Y=Slider(25, range=0..100), Z=remap_31.Mapped)
project_2 = Project(Curve=hex_2.HexagonCells, Brep=srfgrid, Direction=Vector(0, 0, 1))  # -> flatten(Curve)
pl_9 = PlaneNormal(Origin=pt_18, ZAxis=ln_8)
number_slider_15 = Slider(2, range=0..10)  # disabled
remap_33 = RemapNumbers(Value=dist_13, Source=bnd_16, Target=Domain(0, 1))  # -> Mapped, Clipped
pl_10 = ConstructPlane(Origin=eval_3.Point, XAxis=eval_3.Tangent, YAxis=box_5)
panel_51 = Panel(box_6)
pl_11 = ConstructPlane(Origin=eval_6.Point, XAxis=eval_6.Tangent, YAxis=box_8)
scale = Scale(Geometry=move_3.Geometry, Center=end.End, Factor=remap_28.Mapped)  # -> Geometry, Transform
scale_2 = Scale(Geometry=move_4.Geometry, Center=end.End, Factor=remap_28.Mapped)  # -> Geometry, Transform
srfsplit_2 = SurfaceSplit(Surface=srfgrid, Curves=project_2)
graph_20 = GraphMapper(
    remap_33.Mapped,
    x0=0,
    x1=1,
    y0=0,
    y1=1,
    container_name="Bezier",
    cpx=[0, 0, 1, 1],
    cpy=[0, 0.4894984365, 0.4974666238, 1])
graph_21 = GraphMapper(
    remap_33.Mapped,
    x0=0,
    x1=1,
    y0=0,
    y1=1,
    container_name="Bezier",
    cpx=[0, 0.5093007088, 0.4941172898, 1],
    cpy=[0, 0, 1, 1])
range_9 = Range(Domain=Domain(0, 1), Steps=number_slider_15)  # disabled
rotate_6 = Rotate(Geometry=box_5, Angle=degrees(remap_30.Mapped), Plane=pl_10)  # -> Geometry, Transform
rotate_7 = Rotate(Geometry=box_8, Angle=degrees(remap_32.Mapped), Plane=pl_11)  # -> Geometry, Transform
graph_22 = GraphMapper(range_9, x0=0, x1=1, y0=0, y1=1, container_name="Bezier", cpx=[0, 0.6870117188, 0.5780701637, 1], cpy=[0, 0, 1, 1])  # disabled
dom_27 = ConstructDomain(DomainStart=Slider(400, range=0..1000), DomainEnd=Slider(100, range=0..1000))
area_2 = Area(Geometry=srfsplit_2)  # -> Area, Centroid
dom_28 = ConstructDomain(DomainStart=Slider(0, range=0..1000), DomainEnd=Slider(70, range=0..1000))
graft = GraftTree(Tree=join, IncludeEmptyLists=True, IncludeNullItems=True)  # -> simplify(Tree)
graft_2 = GraftTree(Tree=scale.Geometry, IncludeEmptyLists=True, IncludeNullItems=True)  # -> simplify(Tree)
panel_52 = Panel(rotate_6.Geometry)
panel_53 = Panel(area_2.Centroid)
number_slider_16 = Slider(25, range=0..100)
remap_34 = RemapNumbers(Value=graph_20, Source=Domain(0, 1), Target=dom_27)  # -> Mapped, Clipped
rotate_8 = Rotate(Geometry=box_3, Angle=degrees(remap_23.Mapped), Plane=eval.Point)  # -> Geometry, Transform
rotate_9 = Rotate(Geometry=box_4, Angle=degrees(remap_24.Mapped), Plane=eval_2.Point)  # -> Geometry, Transform
remap_35 = RemapNumbers(Value=graph_21, Source=Domain(0, 1), Target=dom_28)  # -> Mapped, Clipped
sph = Sphere(Base=area_2.Centroid, Radius=Slider(10, range=0..100))
rotate_10 = Rotate(Geometry=box_7, Angle=degrees(remap_27.Mapped), Plane=eval_5.Point)  # -> Geometry, Transform
loft_3 = Loft(
    Curves=[graft, graft_2],
    Options={Adjust=False, Closed=False, LoftEnds=0, LoftSimp=0, LoftType=0, Rebuild=10, Refit=0.01})  # -> simplify(graft(Loft))
pframe = PerpFrame(Curve=rotate_5.Geometry, Parameter=graft(graph_22))  # disabled
brep = Brep(simplify(graft(srfsplit)))
brep_2 = Brep(simplify(graft(scale_2.Geometry)))
box_9 = CenterBox(Base=pl_9, X=number_slider_16, Y=number_slider_16, Z=remap_34.Mapped)
orient = Orient(Geometry=flatten(join), Source=xy_2, Target=pframe)  # -> Geometry, Transform; disabled
join_2 = BrepJoin(Breps=[loft_3, brep, brep_2])  # -> Breps, Closed
mesh = MeshBrep(
    Brep=join_2.Breps,
    Settings={GridMaxCount=0, GridMinCount=16, JaggedSeams=False, MaxEdgeLength=0, MinEdgeLength=0.0001, MinTolerance=0, Refine=True, RefineAngle=0, RelativeTolerance=0.65, SimplePlanes=True, Tolerance=0})
mesh_2 = MeshBrep(
    Brep=brep_2,
    Settings={GridMaxCount=0, GridMinCount=16, JaggedSeams=False, MaxEdgeLength=0, MinEdgeLength=0.0001, MinTolerance=0, Refine=True, RefineAngle=0, RelativeTolerance=0.65, SimplePlanes=True, Tolerance=0})
pt_19 = Point(<point referenced from the Rhino model>)
crv_19 = Curve(<curve referenced from the Rhino model>)
crv_20 = Curve(<curve referenced from the Rhino model>)
number_slider_17 = Slider(2, range=0..10)
wbcatmullclark = WeaverbirdsCatmullClarkSubdivision(MeshCurves=mesh, Level=1, SmoothNakedEdges=1)
wbcatmullclark_2 = WeaverbirdsCatmullClarkSubdivision(MeshCurves=mesh_2, Level=1, SmoothNakedEdges=1)
series_16 = Series(Start=0, Step=Slider(0.05, range=0..0.1), Count=Slider(200, range=0..1000))
range_10 = Range(Domain=Domain(0, 1), Steps=number_slider_17)
rotate_11 = Rotate(Geometry=box_9, Angle=degrees(remap_35.Mapped), Plane=pt_18)  # -> Geometry, Transform
tweencrv_9 = TweenCurve(CurveA=crv_20, CurveB=crv_19, Factor=range_10, BlendType=0)

toggle_9 = BooleanToggle(False)
series_17 = Series(Start=0, Step=expr("x+1", number_slider_17), Count=Slider(8, range=0..100))
addition_9 = Addition(A=series_17, B="-1")
panel_54 = Panel(series_17)
path_mapper_9 = PathMapper(source="{A;B} (i)", target="{i\6}")
shift_17 = ShiftList(List=series_17, Shift="-1", Wrap=toggle_9)
shift_18 = ShiftList(List=addition_9, Shift=1, Wrap=toggle_9)
panel_55 = Panel(shift_18)
panel_56 = Panel(shift_17)
dom_29 = ConstructDomain(DomainStart=shift_17, DomainEnd=shift_18)
panel_57 = Panel(dom_29)
subset_9 = SubList(List=series_16, Domain=dom_29, Wrap=Toggle(False))  # -> List, Index
panel_58 = Panel(subset_9.List)

panel_59 = Panel(range_10)
eval_9 = EvaluateCurve(Curve=reparameterize(tweencrv_9), Parameter=subset_9.List)  # -> flatten(Point), flatten(Tangent), Angle
line_9 = LineSDL(Start=eval_9.Point, Direction=eval_9.Tangent, Length=Slider(50, range=0..100))
dist_14 = Distance(PointA=eval_9.Point, PointB=pt_19)
bnd_17 = Bounds(Numbers=dist_14)
bnd_18 = Bounds(Numbers=dist_14)
rotate_12 = Rotate(Geometry=line_9, Angle=Slider(1.5, range=0..10), Plane=eval_9.Point)  # -> Geometry, Transform
remap_36 = RemapNumbers(Value=dist_14, Source=bnd_17, Target=Domain(0, 1))  # -> Mapped, Clipped
remap_37 = RemapNumbers(Value=dist_14, Source=bnd_18, Target=Domain(0, 1))  # -> Mapped, Clipped
pl_12 = ConstructPlane(Origin=eval_9.Point, XAxis=line_9, YAxis=rotate_12.Geometry)
graph_23 = GraphMapper(
    remap_36.Mapped,
    x0=0,
    x1=1,
    y0=0,
    y1=1,
    container_name="Bezier",
    cpx=[0, 0, 0.5028942823, 1],
    cpy=[0, 0.3072421551, 1, 1])
graph_24 = GraphMapper(
    remap_37.Mapped,
    x0=0,
    x1=1,
    y0=0,
    y1=1,
    container_name="Bezier",
    cpx=[0, 0.4968046248, 0.492438823, 1],
    cpy=[0, 0, 1, 1])
dom_30 = ConstructDomain(DomainStart=Slider(200, range=0..1000), DomainEnd=Slider(100, range=0..1000))
dom_31 = ConstructDomain(DomainStart=Slider(0, range=0..1000), DomainEnd=Slider(60, range=0..1000))
remap_38 = RemapNumbers(Value=graph_23, Source=Domain(0, 1), Target=dom_30)  # -> Mapped, Clipped
remap_39 = RemapNumbers(Value=graph_24, Source=Domain(0, 1), Target=dom_31)  # -> Mapped, Clipped
box_10 = CenterBox(Base=pl_12, X=Slider(25, range=0..100), Y=Slider(25, range=0..100), Z=remap_38.Mapped)
pl_13 = ConstructPlane(Origin=eval_9.Point, XAxis=eval_9.Tangent, YAxis=box_10)
crv_21 = Curve([<curve referenced from the Rhino model> x3])  # disabled
rotate_13 = Rotate(Geometry=box_10, Angle=degrees(remap_39.Mapped), Plane=pl_13)  # -> Geometry, Transform
pt_20 = Point(<point referenced from the Rhino model>)  # disabled
number_slider_18 = Slider(15, range=0..100)
pt_21 = Point(<point referenced from the Rhino model>)
crv_22 = Curve(<curve referenced from the Rhino model>)
crv_23 = Curve(<curve referenced from the Rhino model>)
number_slider_19 = Slider(3, range=0..10)
loft_4 = Loft(Curves=crv_21, Options={Adjust=False, Closed=False, LoftEnds=0, LoftSimp=0, LoftType=0, Rebuild=10, Refit=0.01})
series_18 = Series(Start=0, Step=Slider(0.03, range=0..0.1), Count=Slider(200, range=0..1000))
range_11 = Range(Domain=Domain(0, 1), Steps=number_slider_19)
hex_3 = HexagonCells(Surface=loft_4, UDivisions=number_slider_18, VDivisions=number_slider_18, TParameter=Slider(0.25, range=0..1))  # -> HexagonCells, Centers
tweencrv_10 = TweenCurve(CurveA=crv_23, CurveB=crv_22, Factor=range_11, BlendType=0)

toggle_10 = BooleanToggle(False)
series_19 = Series(Start=0, Step=expr("x+1", number_slider_19), Count=Slider(9, range=0..100))
addition_10 = Addition(A=series_19, B="-1")
panel_60 = Panel(series_19)
path_mapper_10 = PathMapper(source="{A;B} (i)", target="{i\6}")
shift_19 = ShiftList(List=series_19, Shift="-1", Wrap=toggle_10)
shift_20 = ShiftList(List=addition_10, Shift=1, Wrap=toggle_10)
panel_61 = Panel(shift_20)
panel_62 = Panel(shift_19)
dom_32 = ConstructDomain(DomainStart=shift_19, DomainEnd=shift_20)
panel_63 = Panel(dom_32)
subset_10 = SubList(List=series_18, Domain=dom_32, Wrap=Toggle(False))  # -> List, Index
panel_64 = Panel(subset_10.List)

panel_65 = Panel(range_11)
project_3 = Project(Curve=hex_3.HexagonCells, Brep=loft_4, Direction=Vector(0, 0, 1))  # -> flatten(Curve)
srfsplit_3 = SurfaceSplit(Surface=loft_4, Curves=project_3)
panel_66 = Panel("""0
1
2
3
4
5
6
7
8
10
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""")
cull_i = CullIndex(List=srfsplit_3, Indices=panel_66, Wrap=True)
item = ListItem(List=srfsplit_3, Index=Slider(1, range=0..100), Wrap=True)
debrep_2 = DeconstructBrep(Brep=cull_i)  # -> Faces, Edges, Vertices
area_3 = Area(Geometry=debrep_2.Faces)  # -> Area, Centroid
ln_9 = Line(StartPoint=area_3.Centroid, EndPoint=pt_20)
pt_22 = Point(flatten(debrep_2.Vertices))
ln_10 = Line(StartPoint=debrep_2.Vertices, EndPoint=area_3.Centroid)
prox = Proximity3D(Points=flatten(pt_22), Group=8)  # -> flatten(Links), Topology
shortwalk = ShortestWalk(Curves=prox.Links, WantedPath=ln_9)  # -> ShortestWalk, Succession, Direction, Length
disc = Discontinuity(Curve=reparameterize(shortwalk.ShortestWalk), Level=1)  # -> Points, simplify(Parameters)
eval_10 = EvaluateCurve(Curve=reparameterize(tweencrv_10), Parameter=subset_10.List)  # -> flatten(Point), flatten(Tangent), Angle
lng = ListLength(List=disc.Points)
dom_33 = ConstructDomain(DomainStart=Slider(1, range=0..10), DomainEnd=Slider(5, range=0..10))
line_10 = LineSDL(Start=eval_10.Point, Direction=eval_10.Tangent, Length=Slider(50, range=0..100))
knots = KnotVector(Count=lng, Degree=3, Periodic=False)
remap_40 = RemapNumbers(Value=disc.Parameters, Source=Domain(0, 1), Target=dom_33)  # -> Mapped, Clipped
nurbcrv = NurbsCurve(Points=disc.Points, Knots=knots)  # -> Curve, Length, Domain
dist_15 = Distance(PointA=eval_10.Point, PointB=pt_21)
bnd_19 = Bounds(Numbers=dist_15)
bnd_20 = Bounds(Numbers=dist_15)
vpipe = PipeVariable(
    Curve=reparameterize(graft(shortwalk.ShortestWalk)),
    Parameters=disc.Parameters,
    Radii=remap_40.Mapped,
    Caps=Slider(1, range=0..10))  # -> simplify(Pipe)
rotate_14 = Rotate(Geometry=line_10, Angle=Slider(1.5, range=0..10), Plane=eval_10.Point)  # -> Geometry, Transform
remap_41 = RemapNumbers(Value=dist_15, Source=bnd_19, Target=Domain(0, 1))  # -> Mapped, Clipped
remap_42 = RemapNumbers(Value=dist_15, Source=bnd_20, Target=Domain(0, 1))  # -> Mapped, Clipped
pl_14 = ConstructPlane(Origin=eval_10.Point, XAxis=line_10, YAxis=rotate_14.Geometry)
graph_25 = GraphMapper(
    remap_41.Mapped,
    x0=0,
    x1=1,
    y0=0,
    y1=1,
    container_name="Bezier",
    cpx=[0, 0, 0.5028942823, 1],
    cpy=[0, 0.3072421551, 1, 1])
graph_26 = GraphMapper(
    remap_42.Mapped,
    x0=0,
    x1=1,
    y0=0,
    y1=1,
    container_name="Bezier",
    cpx=[0, 0.4968046248, 0.492438823, 1],
    cpy=[0, 0, 1, 1])
dom_34 = ConstructDomain(DomainStart=Slider(200, range=0..1000), DomainEnd=Slider(100, range=0..1000))
dom_35 = ConstructDomain(DomainStart=Slider(0, range=0..1000), DomainEnd=Slider(60, range=0..1000))
remap_43 = RemapNumbers(Value=graph_25, Source=Domain(0, 1), Target=dom_34)  # -> Mapped, Clipped
remap_44 = RemapNumbers(Value=graph_26, Source=Domain(0, 1), Target=dom_35)  # -> Mapped, Clipped
box_11 = CenterBox(Base=pl_14, X=Slider(25, range=0..100), Y=Slider(25, range=0..100), Z=remap_43.Mapped)
pl_15 = ConstructPlane(Origin=eval_10.Point, XAxis=eval_10.Tangent, YAxis=box_11)
rotate_15 = Rotate(Geometry=box_11, Angle=degrees(remap_44.Mapped), Plane=pl_15)  # -> Geometry, Transform
pt_23 = Point(<point referenced from the Rhino model>)
crv_24 = Curve(<curve referenced from the Rhino model>)
crv_25 = Curve(<curve referenced from the Rhino model>)
number_slider_20 = Slider(2, range=0..10)
series_20 = Series(Start=0, Step=Slider(0.1, range=0..0.1), Count=Slider(200, range=0..1000))
range_12 = Range(Domain=Domain(0, 1), Steps=number_slider_20)
tweencrv_11 = TweenCurve(CurveA=crv_25, CurveB=crv_24, Factor=range_12, BlendType=0)

toggle_11 = BooleanToggle(False)
series_21 = Series(Start=0, Step=expr("x+1", number_slider_20), Count=Slider(5, range=0..100))
addition_11 = Addition(A=series_21, B="-1")
panel_67 = Panel(series_21)
path_mapper_11 = PathMapper(source="{A;B} (i)", target="{i\6}")
shift_21 = ShiftList(List=series_21, Shift="-1", Wrap=toggle_11)
shift_22 = ShiftList(List=addition_11, Shift=1, Wrap=toggle_11)
panel_68 = Panel(shift_22)
panel_69 = Panel(shift_21)
dom_36 = ConstructDomain(DomainStart=shift_21, DomainEnd=shift_22)
panel_70 = Panel(dom_36)
subset_11 = SubList(List=series_20, Domain=dom_36, Wrap=Toggle(False))  # -> List, Index
panel_71 = Panel(subset_11.List)

panel_72 = Panel(range_12)
eval_11 = EvaluateCurve(Curve=reparameterize(tweencrv_11), Parameter=subset_11.List)  # -> flatten(Point), flatten(Tangent), Angle
line_11 = LineSDL(Start=eval_11.Point, Direction=eval_11.Tangent, Length=Slider(50, range=0..100))
dist_16 = Distance(PointA=eval_11.Point, PointB=pt_23)
bnd_21 = Bounds(Numbers=dist_16)
bnd_22 = Bounds(Numbers=dist_16)
rotate_16 = Rotate(Geometry=line_11, Angle=Slider(1.5, range=0..10), Plane=eval_11.Point)  # -> Geometry, Transform
remap_45 = RemapNumbers(Value=dist_16, Source=bnd_21, Target=Domain(0, 1))  # -> Mapped, Clipped
remap_46 = RemapNumbers(Value=dist_16, Source=bnd_22, Target=Domain(0, 1))  # -> Mapped, Clipped
pl_16 = ConstructPlane(Origin=eval_11.Point, XAxis=line_11, YAxis=rotate_16.Geometry)
graph_27 = GraphMapper(
    remap_45.Mapped,
    x0=0,
    x1=1,
    y0=0,
    y1=1,
    container_name="Bezier",
    cpx=[0, 0, 0.5028942823, 1],
    cpy=[0, 0.3072421551, 1, 1])
graph_28 = GraphMapper(
    remap_46.Mapped,
    x0=0,
    x1=1,
    y0=0,
    y1=1,
    container_name="Bezier",
    cpx=[0, 0.4968046248, 0.492438823, 1],
    cpy=[0, 0, 1, 1])
dom_37 = ConstructDomain(DomainStart=Slider(200, range=0..1000), DomainEnd=Slider(100, range=0..1000))
dom_38 = ConstructDomain(DomainStart=Slider(0, range=0..1000), DomainEnd=Slider(60, range=0..1000))
remap_47 = RemapNumbers(Value=graph_27, Source=Domain(0, 1), Target=dom_37)  # -> Mapped, Clipped
remap_48 = RemapNumbers(Value=graph_28, Source=Domain(0, 1), Target=dom_38)  # -> Mapped, Clipped
box_12 = CenterBox(Base=pl_16, X=Slider(25, range=0..100), Y=Slider(25, range=0..100), Z=remap_47.Mapped)
pl_17 = ConstructPlane(Origin=eval_11.Point, XAxis=eval_11.Tangent, YAxis=box_12)
rotate_17 = Rotate(Geometry=box_12, Angle=degrees(remap_48.Mapped), Plane=pl_17)  # -> Geometry, Transform

lng_2 = ListLength(List=rotate_7.Geometry)
lng_3 = ListLength(List=rotate_13.Geometry)
lng_4 = ListLength(List=rotate_15.Geometry)
lng_5 = ListLength(List=rotate_17.Geometry)
ma_2 = MassAddition(Input=[lng_2, lng_3, lng_4, lng_5])  # -> Result, PartialResults
panel_73 = Panel(ma_2.Result)
