# Grasshopper definition glass.gh (Grasshopper 1.0.7)
# plug-ins: Pufferfish, LunchBox

crv = Curve(<curve referenced from the Rhino model>)
pt = Point(<point referenced from the Rhino model>)
number_slider = Slider(200, range=0..1000)
crv_2 = Curve(<curve referenced from the Rhino model>)
brep = Brep(<brep referenced from the Rhino model>)
pt_2 = Point(<point referenced from the Rhino model>)
brep_2 = Brep(<brep referenced from the Rhino model>)
slider = Slider(100, range=0..100)
number_slider_2 = Slider(200, range=0..1000)
crv_3 = Curve(<curve referenced from the Rhino model>)
number_slider_3 = Slider(10, range=0..100)
number_slider_4 = Slider(10, range=0..100)
xy = XYPlane(Origin=pt)
xy_2 = XYPlane(Origin=pt_2)
seam = Seam(Curve=reparameterize(crv), Seam=Slider(0.25, range=0..1))
series = Series(Start=0, Step=number_slider_3, Count=Slider(60, range=0..100))
series_2 = Series(Start=0, Step=number_slider_4, Count=Slider(60, range=0..100))
Z = UnitZ(Factor=series)
Z_2 = UnitZ(Factor=series_2)
grid = GridStructure(Surface=crv_2, UDivisions=number_slider, VDivisions=number_slider)  # -> StructureLines, StructureNodes
mplane = MeshPlane(Boundary=seam, WidthCount=slider, HeightCount=Slider(100, range=0..100))  # -> Mesh, Area
grid_2 = GridStructure(Surface=crv_3, UDivisions=number_slider_2, VDivisions=number_slider_2)  # -> StructureLines, StructureNodes
move = Move(Geometry=xy, Motion=Z)  # -> Geometry, Transform
move_2 = Move(Geometry=xy_2, Motion=Z_2)  # -> Geometry, Transform
pt_3 = Point([<point referenced from the Rhino model> x4])
demesh = DeconstructMesh(Mesh=mplane.Mesh)  # -> Vertices, Faces, Colours, Normals
pt_4 = Point([<point referenced from the Rhino model> x4])
sec = BrepPlane(Brep=brep, Plane=move.Geometry)  # -> Curves, Points
pt_5 = Point([<point referenced from the Rhino model> x4])
sec_2 = BrepPlane(Brep=brep_2, Plane=move_2.Geometry)  # -> Curves, Points
cp = ClosestPoint(Point=graft(demesh.Vertices), Cloud=pt_3)  # -> ClosestPoint, CPIndex, simplify(Distance)
boundary = BoundarySurfaces(Edges=sec.Curves)
boundary_2 = BoundarySurfaces(Edges=sec_2.Curves)
cp_2 = ClosestPoint(Point=graft(grid.StructureNodes), Cloud=pt_4)  # -> ClosestPoint, CPIndex, simplify(Distance)
dist = Distance(PointA=pt_3, PointB=graft(demesh.Vertices))  # -> simplify(Distance)
cp_3 = ClosestPoint(Point=graft(grid_2.StructureNodes), Cloud=pt_5)  # -> ClosestPoint, CPIndex, simplify(Distance)
dist_2 = Distance(PointA=pt_4, PointB=graft(grid.StructureNodes))  # -> simplify(Distance)
bnd = Bounds(Numbers=flatten(dist))
Z_3 = UnitZ(Factor=number_slider_3)
dist_3 = Distance(PointA=pt_5, PointB=graft(grid_2.StructureNodes))  # -> simplify(Distance)
Z_4 = UnitZ(Factor=number_slider_4)
bnd_2 = Bounds(Numbers=flatten(dist_2))
remap = RemapNumbers(Value=dist, Source=bnd, Target=Domain(0, 1))  # -> Mapped, Clipped
extr = Extrude(Base=boundary, Direction=Z_3)
extr_2 = Extrude(Base=boundary_2, Direction=Z_4)
bnd_3 = Bounds(Numbers=flatten(dist_3))
remap_2 = RemapNumbers(Value=dist_2, Source=bnd_2, Target=Domain(0, 1))  # -> Mapped, Clipped
graph = GraphMapper(
    remap.Mapped,
    x0=0,
    x1=1,
    y0=0,
    y1=1,
    container_name="Sinc",
    Equation_X0=0,
    Equation_X1=0.08479495347,
    Equation_Y0=0.6117571592,
    Equation_Y1=0.5579064488)
remap_3 = RemapNumbers(Value=dist_3, Source=bnd_3, Target=Domain(0, 1))  # -> Mapped, Clipped
graph_2 = GraphMapper(
    remap_2.Mapped,
    x0=0,
    x1=1,
    y0=0,
    y1=1,
    container_name="Sinc",
    Equation_X0=0,
    Equation_X1=0.0407089591,
    Equation_Y0=0.5977624059,
    Equation_Y1=0.5564601421)
graph_3 = GraphMapper(
    remap_3.Mapped,
    x0=0,
    x1=1,
    y0=0,
    y1=1,
    container_name="Sinc",
    Equation_X0=0,
    Equation_X1=0.05305964872,
    Equation_Y0=0.5977624059,
    Equation_Y1=0.5580665469)
ma = MassAddition(Input=graph)  # -> flatten(Result), PartialResults
ma_2 = MassAddition(Input=graph_2)  # -> flatten(Result), PartialResults
wave_height = Slider(172.226, range=0..1000)
dam = DataDam(DataA=ma.Result, BufferDelay=20000000, BufferMode=2)
ma_3 = MassAddition(Input=graph_3)  # -> flatten(Result), PartialResults
wave_height_2 = Slider(145, range=0..1000)
dam_2 = DataDam(DataA=ma_2.Result, BufferDelay=20000000, BufferMode=2)
bnd_4 = Bounds(Numbers=flatten(dam))
wave_height_3 = Slider(150, range=0..1000)
dam_3 = DataDam(DataA=ma_3.Result, BufferDelay=20000000, BufferMode=2)
bnd_5 = Bounds(Numbers=flatten(dam_2))
remap_4 = RemapNumbers(Value=dam, Source=bnd_4, Target=wave_height)  # -> Mapped, Clipped
bnd_6 = Bounds(Numbers=flatten(dam_3))
remap_5 = RemapNumbers(Value=dam_2, Source=bnd_5, Target=wave_height_2)  # -> Mapped, Clipped
remap_6 = RemapNumbers(Value=dam_3, Source=bnd_6, Target=wave_height_3)  # -> Mapped, Clipped
Z_5 = UnitZ(Factor=remap_4.Mapped)
Z_6 = UnitZ(Factor=remap_5.Mapped)
move_3 = Move(Geometry=demesh.Vertices, Motion=Z_5)  # -> Geometry, Transform
Z_7 = UnitZ(Factor=remap_6.Mapped)
move_4 = Move(Geometry=grid.StructureNodes, Motion=Z_6)  # -> Geometry, Transform
move_5 = Move(Geometry=grid_2.StructureNodes, Motion=Z_7)  # -> Geometry, Transform
divide = DivideCurve(Curve=seam, Count=Slider(50, range=0..100), Kinks=False)  # -> flatten(Points), Tangents, Parameters
cp_4 = ClosestPoint(Point=move_3.Geometry, Cloud=divide.Points)  # -> ClosestPoint, CPIndex, Distance
bnd_7 = Bounds(Numbers=cp_4.Distance)
remap_7 = RemapNumbers(Value=cp_4.Distance, Source=bnd_7, Target=Domain(0, 1))  # -> Mapped, Clipped
panel = Panel(remap_7.Mapped)
neg = Negative(Value=remap_7.Mapped)
Z_8 = UnitZ(Factor=neg)
ln = Line(StartPoint=grid.StructureNodes, EndPoint=move_4.Geometry)
divide_2 = DivideCurve(Curve=crv_2, Count=Slider(200, range=0..1000), Kinks=False)  # -> Points, Tangents, Parameters
ln_2 = Line(StartPoint=grid_2.StructureNodes, EndPoint=move_5.Geometry)
divide_3 = DivideCurve(Curve=crv_3, Count=Slider(200, range=0..1000), Kinks=False)  # -> Points, Tangents, Parameters
cp_5 = ClosestPoint(Point=grid.StructureNodes, Cloud=divide_2.Points)  # -> ClosestPoint, CPIndex, Distance
dom = ConstructDomain(DomainStart=Slider(1, range=0..1000), DomainEnd=Slider(1, range=0..1000))
cp_6 = ClosestPoint(Point=grid_2.StructureNodes, Cloud=divide_3.Points)  # -> ClosestPoint, CPIndex, Distance
dom_2 = ConstructDomain(DomainStart=Slider(1, range=0..1000), DomainEnd=Slider(1, range=0..1000))
ln_3 = Line(StartPoint=grid.StructureNodes, EndPoint=cp_5.ClosestPoint)
move_6 = Move(Geometry=move_3.Geometry, Motion=Z_8)  # -> Geometry, Transform
lng = ListLength(List=cp_5.Distance)  # -> expr("X-1", Length)
ln_4 = Line(StartPoint=grid_2.StructureNodes, EndPoint=cp_6.ClosestPoint)
lng_2 = ListLength(List=cp_6.Distance)  # -> expr("X-1", Length)
bnd_8 = Bounds(Numbers=cp_5.Distance)
ln_5 = Line(StartPoint=demesh.Vertices, EndPoint=move_6.Geometry)
range = Range(Domain=dom, Steps=lng)
bnd_9 = Bounds(Numbers=cp_6.Distance)
range_2 = Range(Domain=dom_2, Steps=lng_2)
remap_8 = RemapNumbers(Value=cp_5.Distance, Source=bnd_8, Target=range)  # -> Mapped, Clipped
pt_6 = Point(<point referenced from the Rhino model>)
pt_7 = Point(<point referenced from the Rhino model>)
pt_8 = Point(<point referenced from the Rhino model>)
remap_9 = RemapNumbers(Value=cp_6.Distance, Source=bnd_9, Target=range_2)  # -> Mapped, Clipped
boundary_3 = BoundarySurfaces(Edges=seam)
eval = EvaluateCurve(Curve=ln, Parameter=remap_8.Mapped)  # -> Point, Tangent, Angle
project = ProjectPoint(Point=pt_8, Direction=Vector(0, 0, -1), Geometry=boundary_3)  # -> Point, Index
project_2 = ProjectPoint(Point=pt_6, Direction=Vector(0, 0, -1), Geometry=boundary_3)  # -> Point, Index
project_3 = ProjectPoint(Point=pt_7, Direction=Vector(0, 0, -1), Geometry=boundary_3)  # -> Point, Index
eval_2 = EvaluateCurve(Curve=ln_2, Parameter=remap_9.Mapped)  # -> Point, Tangent, Angle
divide_4 = DivideCurve(Curve=seam, Count=Slider(200, range=0..1000), Kinks=False)  # -> flatten(Points), Tangents, Parameters
srfgrid = SurfaceFromPoints(Points=eval.Point, UCount=expr("x+1", number_slider), Interpolate=False)
cp_7 = ClosestPoint(Point=demesh.Vertices, Cloud=divide_4.Points)  # -> ClosestPoint, CPIndex, Distance
srfgrid_2 = SurfaceFromPoints(Points=eval_2.Point, UCount=expr("x+1", number_slider_2), Interpolate=False)
popgeo = PopulateGeometry(Geometry=boundary_3, Count=Slider(100, range=0..1000), Seed=Slider(1, range=0..10))  # -> flatten(Population)
fspin = SpinForce(Plane=project_2.Point, Strength=Slider(200, range=0..1000), Radius=Slider(300, range=0..1000), Decay=2)
fspin_2 = SpinForce(Plane=project_3.Point, Strength=Slider(150, range=0..1000), Radius=Slider(200, range=0..1000), Decay=2)
fspin_3 = SpinForce(Plane=project.Point, Strength=Slider(150, range=0..1000), Radius=Slider(200, range=0..1000), Decay=2)
dom_3 = ConstructDomain(DomainStart=Slider(0, range=0..1), DomainEnd=Slider(1, range=0..1))
lng_3 = ListLength(List=cp_7.Distance)
range_3 = Range(Domain=dom_3, Steps=expr("x-1", lng_3))
bnd_10 = Bounds(Numbers=cp_7.Distance)
cp_8 = ClosestPoint(Point=popgeo, Cloud=[pt_6, pt_7, pt_8])  # -> ClosestPoint, CPIndex, Distance
mergef = MergeFields(Fields=[fspin, fspin_2, fspin_3])
remap_10 = RemapNumbers(Value=cp_7.Distance, Source=bnd_10, Target=range_3)  # -> Mapped, Clipped
multiplication = Multiplication(A=cp_8.Distance, B=Slider(9.6, range=0..10))
eval_3 = EvaluateCurve(Curve=ln_5, Parameter=remap_10.Mapped)  # -> Point, Tangent, Angle
fline = FieldLine(Field=mergef, Point=popgeo, Steps=multiplication, Accuracy=0.1, Method=3)
ln_6 = Line(StartPoint=demesh.Vertices, EndPoint=eval_3.Point)
reb = RebuildCurve(Curve=fline, Count=Slider(50, range=0..100), Tangents=False)
srfgrid_3 = SurfaceFromPoints(Points=eval_3.Point, UCount=expr("x+1", slider), Interpolate=Toggle(False))
dam_4 = DataDam(DataA=reb, BufferDelay=10000000, BufferMode=0)
offcrv = OffsetCurve(
    Curve=dam_4,
    Plane=PlaneXY(0, 0, 0),
    Distance=Slider(3, range=0..100),
    BothSides=Toggle(True),
    Kinks=0,
    CapType=Slider(1, range=0..100))
boundary_4 = BoundarySurfaces(Edges=offcrv)
graft = GraftTree(Tree=dam_4, IncludeEmptyLists=True, IncludeNullItems=True)
Z_9 = UnitZ(Factor=Slider(200, range=0..1000))
extr_3 = Extrude(Base=boundary_4, Direction=Z_9)
Z_10 = UnitZ(Factor=Slider(20, range=0..100))
move_7 = Move(Geometry=offcrv, Motion=Z_10)  # -> Geometry, Transform; disabled
panel_2 = Panel(graft)
item = ListItem(List=move_7.Geometry, Index=Slider(1, range=0..1), Wrap=True)
item_2 = ListItem(List=move_7.Geometry, Index=Slider(0, range=0..1), Wrap=True)
loft = Loft(Curves=[graft, item_2], Options={Adjust=False, Closed=False, LoftEnds=0, LoftSimp=0, LoftType=0, Rebuild=10, Refit=0.01})
loft_2 = Loft(Curves=[graft, item], Options={Adjust=False, Closed=False, LoftEnds=0, LoftSimp=0, LoftType=0, Rebuild=10, Refit=0.01})
loft_3 = Loft(Curves=[item, item_2], Options={Adjust=False, Closed=False, LoftEnds=0, LoftSimp=0, LoftType=0, Rebuild=10, Refit=0.01})
project_4 = Project(Curve=dam_4, Brep=srfgrid_3, Direction=Vector(0, 0, 1))  # disabled
join = BrepJoin(Breps=[loft_2, loft, loft_3])  # -> Breps, Closed
number_slider_5 = Slider(0, range=0..100)  # disabled
capex = CapHolesEx(Brep=join.Breps)  # -> Brep, Caps, Solid
eval_4 = EvaluateCurve(Curve=project_4, Parameter=number_slider_5)  # -> Point, Tangent, Angle; disabled
crv_4 = Curve(<curve referenced from the Rhino model>)  # disabled
pt_9 = Point(<point referenced from the Rhino model>)  # disabled
pl = PlaneNormal(Origin=eval_4.Point, ZAxis=eval_4.Tangent)  # disabled
xz = XZPlane(Origin=pt_9)  # disabled
orient = Orient(Geometry=crv_4, Source=xz, Target=pl)  # -> Geometry, Transform; disabled
