# Grasshopper definition wall_boxes.gh (Grasshopper 1.0.7)
# plug-ins: OpenNest

geo = Geometry([<brep referenced from the Rhino model> x24])
crv = Curve(<curve referenced from the Rhino model>)
opennest = OpenNest(
    Sheets=crv,
    Geo=geo,
    Spacing=Slider(1, range=0..100),
    Placement=Slider(4, range=0..5),
    Tolerance=Slider(0.1, range=0..0.1),
    Rotations=Slider(4, range=0..10000),
    Iterations=Slider(0, range=0..100),
    Seed=Slider(2, range=0..10),
    Reset=Toggle(True),
    Run=Toggle(True))  # -> Sheets, Geo, ID, Transform, IDS
brep = Brep(opennest.Geo)
