# Grasshopper definition diamond_panels.gh (Grasshopper 1.0.7)
# plug-ins: LunchBox

xz = XZPlane(Origin=Point(0, 0, 0))
planesrf = PlaneSurface(Plane=xz, XSize=Slider(40, range=0..100), YSize=Slider(20, range=0..100))
debrep = DeconstructBrep(Brep=planesrf)  # -> Faces, Edges, Vertices
diamond = DiamondPanels(Surface=planesrf, UDivisions=Slider(20, range=0..100), VDivisions=Slider(20, range=0..100))  # -> DiamondPanels, TriPanels
item = ListItem(List=debrep.Vertices, Index=0, Wrap=True)  # -> Item, Item1, Item2
merge = Merge(Data1=item.Item, Data2=item.Item1, Data3=item.Item2)
offset = OffsetCurve(Curve=diamond.DiamondPanels, Distance=expr("-x", Slider(0.2, range=0..1)), Corners=1)  # -> flatten(Curve)
nurbs = NurbsCurve(Vertices=merge, Degree="2", Periodic=False)  # -> Curve, Length, Domain
area = Area(Geometry=offset)  # -> Area, Centroid
pull = PullPoint(Point=area.Centroid, Geometry=nurbs.Curve, ClosestOnly=True)  # -> ClosestPoint, Distance
bnd = Bounds(Numbers=pull.Distance)
dom = ConstructDomain(DomainStart=Slider(0.8, range=0..1), DomainEnd=Slider(0.1, range=0..1))
remap = RemapNumbers(Value=pull.Distance, Source=bnd, Target=dom)  # -> Mapped, Clipped
scale_nu = ScaleNU(Geometry=offset, Plane=area.Centroid, ScaleX=1, ScaleY=1, ScaleZ=remap.Mapped)  # -> Geometry, Transform
crv = Curve(planesrf)
crv_2 = Curve(scale_nu.Geometry)
boundary = BoundarySurfaces(Edges=flatten([crv, crv_2]))
Y = UnitY(Factor="0.2")
neg = Negative(Value=Y)
extr = Extrude(Base=boundary, Direction=neg)
