# Grasshopper definition voronoi_Warminska Shopping Gallery.gh (Grasshopper 1.0.7)

number_slider = Slider(35, range=0..100)
xy = XYPlane(Origin=Point(0, 0, 0))
Z = UnitZ(Factor=Slider(50, range=0..100))
rectangle = Rectangle(Plane=xy, XSize=number_slider, YSize=number_slider, Radius=Slider(6, range=0..10))  # -> Rectangle, Length
extr = Extrude(Base=rectangle.Rectangle, Direction=Z)
X = UnitX(Factor=Slider(52, range=0..100))
dedom2num = DeconstructDomain²(Domain=extr)  # -> UMin, UMax, VMin, VMax
move = Move(Geometry=extr, Motion=X)  # -> Geometry, Transform
rectangle_2 = Rectangle(Plane=xy, XSize=dedom2num.UMax, YSize=dedom2num.VMax, Radius=0)  # -> Rectangle, Length
explode = Explode(Curve=rectangle_2.Rectangle, Recursive=True)  # -> Segments, Vertices
item = ListItem(List=explode.Segments, Index=Slider(1, range=0..10), Wrap=True)
pop2d = Populate2D(Region=rectangle_2.Rectangle, Count=Slider(500, range=0..10000), Seed=1)
crv_cp = CurveClosestPoint(Point=pop2d, Curve=item)  # -> Point, Parameter, Distance
voronoi = Voronoi(Points=pop2d, Boundary=rectangle_2.Rectangle, BruteForceOverride=False)
dom = ConstructDomain(DomainStart=Slider(0.45, range=0..1), DomainEnd=Slider(0.85, range=0..1))
bnd = Bounds(Numbers=crv_cp.Distance)
remap = RemapNumbers(Value=crv_cp.Distance, Source=bnd, Target=dom)  # -> Mapped, Clipped
scale = Scale(Geometry=voronoi, Center=pop2d, Factor=remap.Mapped)  # -> Geometry, Transform
sort = SortList(Keys=crv_cp.Distance, ValuesValuesA=scale.Geometry)  # -> Keys, ValuesValuesA
lng = ListLength(List=sort.Keys)
dom_2 = ConstructDomain(DomainStart=Slider(0.55, range=0..1), DomainEnd=Slider(0.85, range=0..1))
multiplication = Multiplication(A=lng, B=Slider(0.45, range=0..1))
jitter = Jitter(List=sort.ValuesValuesA, Jitter=dom_2, Seed=Slider(7, range=0..10))  # -> Values, Indices
subset = SubList(List=jitter.Values, Domain=multiplication, Wrap=True)  # -> List, Index
Z_2 = UnitZ(Factor=Slider(0.1, range=0..0.1))
boundary = BoundarySurfaces(Edges=subset.List)
rulesrf = RuledSurface(CurveA=voronoi, CurveB=scale.Geometry)
extr_2 = Extrude(Base=[rulesrf, boundary], Direction=Z_2)  # -> flatten(Extrusion)
srf = Surface(move.Geometry)
dedom2 = DeconstructDomain²(Domain=srf)  # -> UComponent, VComponent
bbox = BoundingBox(Content=extr_2, Plane=PlaneXY(0, 0, 0), UnionBox=True)  # -> Box, Box_2
srfmorph = SurfaceMorph(
    Geometry=extr_2,
    Reference=bbox.Box,
    Surface=srf,
    UDomain=dedom2.UComponent,
    VDomain=dedom2.VComponent,
    WDomain=Slider(-0.1, range=-0.1..0))  # disabled
