# Grasshopper definition wood.gh (Grasshopper 1.0.7)
# plug-ins: Pufferfish

crv = Curve(<curve referenced from the Rhino model>)
slider = Slider(100, range=0..100)
slider_2 = Slider(100, range=0..100)
mplane = MeshPlane(Boundary=crv, WidthCount=slider, HeightCount=slider_2)  # -> Mesh, Area
sdivide = DivideSurface(Surface=crv, UCount=slider, VCount=slider_2)  # -> flatten(Points), Normals, Parameters
demesh = DeconstructMesh(Mesh=mplane.Mesh)  # -> Vertices, Faces, Colours, Normals
pt = Point([<point referenced from the Rhino model> x3])
dist = Distance(PointA=pt, PointB=graft(demesh.Vertices))  # -> simplify(Distance)
bnd = Bounds(Numbers=flatten(dist))
remap = RemapNumbers(Value=dist, Source=bnd, Target=Domain(0, 1))  # -> Mapped, Clipped
graph = GraphMapper(
    remap.Mapped,
    x0=0,
    x1=1,
    y0=0,
    y1=1,
    container_name="Sinc",
    Equation_X0=0,
    Equation_X1=0.03050194681,
    Equation_Y0=0.6041887999,
    Equation_Y1=0.5463796854)
ma = MassAddition(Input=graph)  # -> flatten(Result), PartialResults
dam = DataDam(DataA=ma.Result, BufferDelay=20000000, BufferMode=2)
wave_height = Slider(100, range=0..1000)
bnd_2 = Bounds(Numbers=flatten(dam))
remap_2 = RemapNumbers(Value=dam, Source=bnd_2, Target=wave_height)  # -> Mapped, Clipped
Z = UnitZ(Factor=remap_2.Mapped)
move = Move(Geometry=demesh.Vertices, Motion=Z)  # -> Geometry, Transform
divide = DivideCurve(Curve=crv, Count=Slider(50, range=0..100), Kinks=False)  # -> flatten(Points), Tangents, Parameters
cp = ClosestPoint(Point=move.Geometry, Cloud=divide.Points)  # -> ClosestPoint, CPIndex, Distance
bnd_3 = Bounds(Numbers=cp.Distance)
dom = ConstructDomain(DomainStart=Slider(0, range=0..1000), DomainEnd=Slider(0, range=0..1000))
remap_3 = RemapNumbers(Value=cp.Distance, Source=bnd_3, Target=dom)  # -> Mapped, Clipped
neg = Negative(Value=remap_3.Mapped)
Z_2 = UnitZ(Factor=neg)
move_2 = Move(Geometry=move.Geometry, Motion=Z_2)  # -> Geometry, Transform
ln = Line(StartPoint=demesh.Vertices, EndPoint=move_2.Geometry)
pt_2 = Point(<point referenced from the Rhino model>)
pt_3 = Point(<point referenced from the Rhino model>)
pt_4 = Point(<point referenced from the Rhino model>)
boundary = BoundarySurfaces(Edges=crv)
project = ProjectPoint(Point=pt_4, Direction=Vector(0, 0, -1), Geometry=boundary)  # -> Point, Index
project_2 = ProjectPoint(Point=pt_2, Direction=Vector(0, 0, -1), Geometry=boundary)  # -> Point, Index
project_3 = ProjectPoint(Point=pt_3, Direction=Vector(0, 0, -1), Geometry=boundary)  # -> Point, Index
divide_2 = DivideCurve(Curve=crv, Count=Slider(200, range=0..1000), Kinks=False)  # -> flatten(Points), Tangents, Parameters
cp_2 = ClosestPoint(Point=demesh.Vertices, Cloud=divide_2.Points)  # -> ClosestPoint, CPIndex, Distance
popgeo = PopulateGeometry(Geometry=boundary, Count=Slider(100, range=0..1000), Seed=Slider(1, range=0..10))  # -> flatten(Population)
fspin = SpinForce(Plane=project_2.Point, Strength=Slider(200, range=0..1000), Radius=Slider(300, range=0..1000), Decay=2)
fspin_2 = SpinForce(Plane=project_3.Point, Strength=Slider(150, range=0..1000), Radius=Slider(200, range=0..1000), Decay=2)
fspin_3 = SpinForce(Plane=project.Point, Strength=Slider(150, range=0..1000), Radius=Slider(200, range=0..1000), Decay=2)
dom_2 = ConstructDomain(DomainStart=Slider(0, range=0..1), DomainEnd=Slider(1, range=0..1))
lng = ListLength(List=cp_2.Distance)
range = Range(Domain=dom_2, Steps=expr("x-1", lng))
bnd_4 = Bounds(Numbers=cp_2.Distance)
cp_3 = ClosestPoint(Point=popgeo, Cloud=[pt_2, pt_3, pt_4])  # -> ClosestPoint, CPIndex, Distance
mergef = MergeFields(Fields=[fspin, fspin_2, fspin_3])
remap_4 = RemapNumbers(Value=cp_2.Distance, Source=bnd_4, Target=range)  # -> Mapped, Clipped
multiplication = Multiplication(A=cp_3.Distance, B=Slider(9.6, range=0..10))
eval = EvaluateCurve(Curve=ln, Parameter=remap_4.Mapped)  # -> Point, Tangent, Angle
fline = FieldLine(Field=mergef, Point=popgeo, Steps=multiplication, Accuracy=0.1, Method=3)
ln_2 = Line(StartPoint=demesh.Vertices, EndPoint=eval.Point)
reb = RebuildCurve(Curve=fline, Count=Slider(50, range=0..100), Tangents=False)
srfgrid = SurfaceFromPoints(Points=eval.Point, UCount=expr("x+1", slider), Interpolate=False)
dam_2 = DataDam(DataA=reb, BufferDelay=10000000, BufferMode=0)
offcrv = OffsetCurve(
    Curve=dam_2,
    Plane=PlaneXY(0, 0, 0),
    Distance=Slider(3, range=0..100),
    BothSides=Toggle(True),
    Kinks=0,
    CapType=Slider(1, range=0..100))
boundary_2 = BoundarySurfaces(Edges=offcrv)
graft = GraftTree(Tree=dam_2, IncludeEmptyLists=True, IncludeNullItems=True)
Z_3 = UnitZ(Factor=Slider(200, range=0..1000))
extr = Extrude(Base=boundary_2, Direction=Z_3)
Z_4 = UnitZ(Factor=Slider(20, range=0..100))
move_3 = Move(Geometry=offcrv, Motion=Z_4)  # -> Geometry, Transform; disabled
panel = Panel(graft)
item = ListItem(List=move_3.Geometry, Index=Slider(1, range=0..1), Wrap=True)
item_2 = ListItem(List=move_3.Geometry, Index=Slider(0, range=0..1), Wrap=True)
loft = Loft(Curves=[graft, item_2], Options={Adjust=False, Closed=False, LoftEnds=0, LoftSimp=0, LoftType=0, Rebuild=10, Refit=0.01})
loft_2 = Loft(Curves=[graft, item], Options={Adjust=False, Closed=False, LoftEnds=0, LoftSimp=0, LoftType=0, Rebuild=10, Refit=0.01})
loft_3 = Loft(Curves=[item, item_2], Options={Adjust=False, Closed=False, LoftEnds=0, LoftSimp=0, LoftType=0, Rebuild=10, Refit=0.01})
project_4 = Project(Curve=dam_2, Brep=srfgrid, Direction=Vector(0, 0, 1))  # disabled
join = BrepJoin(Breps=[loft_2, loft, loft_3])  # -> Breps, Closed
number_slider = Slider(0, range=0..100)  # disabled
capex = CapHolesEx(Brep=join.Breps)  # -> Brep, Caps, Solid
eval_2 = EvaluateCurve(Curve=project_4, Parameter=number_slider)  # -> Point, Tangent, Angle; disabled
crv_2 = Curve(<curve referenced from the Rhino model>)  # disabled
pt_5 = Point(<point referenced from the Rhino model>)  # disabled
pl = PlaneNormal(Origin=eval_2.Point, ZAxis=eval_2.Tangent)  # disabled
xz = XZPlane(Origin=pt_5)  # disabled
orient = Orient(Geometry=crv_2, Source=xz, Target=pl)  # -> Geometry, Transform; disabled
