# Grasshopper definition skewed_facede.gh (Grasshopper 1.0.7)
# plug-ins: LunchBox, treesloth01

xz = XZPlane(Origin=Point(0, 0, 0))
planesrf = PlaneSurface(Plane=xz, XSize=Slider(40, range=0..100), YSize=Slider(20, range=0..100))
squads = SkewedQuads(Surface=planesrf, UDivisions=10, VDivisions=10, TParameter=0)  # -> graft(FullPanels), EdgePanels
runion = RegionUnion(Curves=planesrf)
area = Area(Geometry=squads.FullPanels)  # -> Area, Centroid
scale = Scale(Geometry=squads.FullPanels, Center=area.Centroid, Factor=Slider(0.93, range=0..1))  # -> Geometry, Transform
boundary = BoundarySurfaces(Edges=flatten([runion, scale.Geometry]))
sdivide = DivideSurface(Surface=scale.Geometry, UCount="2", VCount="2")  # -> Points, Normals, Parameters
shift = ShiftPaths(Data=sdivide.Points, Offset=-1)
Y = UnitY(Factor=Slider(0.6, range=0..1))
item = ListItem(List=shift, Index="4", Wrap=True)
neg = Negative(Value=Y)
move = Move(Geometry=item, Motion=neg)  # -> Geometry, Transform
replace = ReplaceItems(List=shift, Item=move.Geometry, Indices="4", Wrap=False)
srfgrid = SurfaceFromPoints(Points=replace, UCount=expr("x+1", "2"), Interpolate=Toggle(True))
