# Grasshopper definition 1.gh (Grasshopper 1.0.7)

planesrf = PlaneSurface(Plane=PlaneXY(0, 0, 0), XSize=Domain(-10, 10), YSize=Domain(-10, 10))
cir = Circle(Plane=PlaneXY(0, 0, 0), Radius=1)
python = GhPythonScript(x=cir, y=planesrf)  # -> out, a
# ---------- python: Python ----------
import rhinoscriptsyntax as rs
import Rhino.Geometry as rg
import System.Drawing as sd
from Grasshopper.Kernel import GH_RuntimeMessageLevel as rel

circles = rs. Getx
brep = y

for circle in circles:
    pt = rs.CircleCenterPoint(circle)
    is_on = rs.IsPointOnSurface(brep, pt)
    if is_on:
            rs.ObjectColor(circle, (230,230,230))
# ---------- end python ----------
python_2 = GhPythonScript(step=Slider(17, range=0..100), min=Slider(0, range=0..100), max=Slider(255, range=0..1000))  # -> out, a
# ---------- python_2: Python ----------
import rhinoscriptsyntax as rs

step = int(step)
min = int(min)
max = int(max)

points = []
colours = []

for x in range(0,11, 2):
    print(x)
# ---------- end python_2 ----------
panel = Panel(python.out)
