# Grasshopper definition box.gh (Grasshopper 1.0.7)

number_slider = Slider(11, range=0..100)
number_slider_2 = Slider(10, range=0..100)
python = GhPythonScript(sX=number_slider_2, sY=number_slider_2, sZ=number_slider_2, eX=number_slider, eY=number_slider)  # -> out, geo, colours; inputs sX: Int32, sY: Int32, sZ: Int32, eX: Int32, eY: Int32
# ---------- python: Python ----------
import rhinoscriptsyntax as rs
import Rhino.Geometry as rg
import System.Drawing as sd
from Grasshopper.Kernel import GH_RuntimeMessageLevel as rel

if type(eX) != int:
    try:
        eX = int(eX)
    except:
        ghenv.Component.AddRuntimeMessage(rel.Error, "Ex allow only integers.")

geo = []
colours = []

for x in range(eX):
    for y in range(eY):
        pt1 = rg.Point3d(x*sX, y*sY, 0)
        pt2 = rg.Point3d(x*sX + 1, y*sY, 0)
        pt3 = rg.Point3d(x*sX, y*sY + 1, 0)
        plane = rs.PlaneFromPoints(pt1, pt2, pt3)
        geo.append(rg.Box(plane, rg.Interval(sX/2*-1, sX/2), rg.Interval(sY/2*-1, sY/2), rg.Interval(rg.Interval(sZ/2*-1, sZ/2)))
        colours.append(sd.Color.FromArgb(x/sX*255, y*sY/255, 150))
# ---------- end python ----------
preview = CustomPreview(Geometry=python.geo, Material=python.colours)
