# Grasshopper definition colours.gh (Grasshopper 1.0.7)

python = GhPythonScript(step=Slider(17, range=0..100), min=Slider(0, range=0..100), max=Slider(255, range=0..1000))  # -> out, points, colours
# ---------- python: Python ----------
import rhinoscriptsyntax as rs
import System.Drawing as sd

step = int(step)
min = int(min)
max = int(max)

points = []
colours = []

for x in range(min, max, step):
    for y in range(min, max, step):
        for z in range(min, max, step):
            points.append(rs.AddPoint(x, y, z))
            colours.append(sd.Color.FromArgb(x, y, z))
# ---------- end python ----------
preview = CustomPreview(Geometry=python.points, Material=python.colours)
panel = Panel(python.out)
