# Grasshopper definition divideCurve.gh (Grasshopper 1.0.7)

crv = Curve(<curve referenced from the Rhino model>)
python = GhPythonScript(C=crv, N=Slider(11, range=0..100), K=Toggle(False), min=Slider(11, range=0..100), pF=Toggle(True))  # -> out, P, T, t, F; inputs C: Curve
# ---------- python: Python ----------
import rhinoscriptsyntax as rs
import ghpythonlib.components as ghc
import Rhino.Geometry as rg

esg = ""

if ghc.Length(C) < min:
    esg = "Curve is too short!"
else:
    esg = "All good."
    P = ghc.DivideCurve(C, N, K)[0]
    if pF:
        T = ghc.DivideCurve(C, N, K)[1]
        t = ghc.DivideCurve(C, N, K)[2]
        F = ghc.PerpFrame(C, t)
        msg = "All good with frames!"
print(msg)
# ---------- end python ----------
panel = Panel(python.out)
pt = Point(python.P)
