# Grasshopper definition sumList.gh (Grasshopper 1.0.7)

panel = Panel("""2.0
1.0
0.5""")
panel_2 = Panel("""2.0
1.0
0.5""")
panel_3 = Panel("""2.0
1.0
0.5""")
panel_4 = Panel("""2.0
1.0
0.5""")
panel_5 = Panel("""2.0
1.0
0.5""")
dup = DuplicateData(Data=panel, Number=Slider(9, range=0..10), Order=Toggle(True))
dup_2 = DuplicateData(Data=panel_2, Number=Slider(9, range=0..10), Order=Toggle(True))
dup_3 = DuplicateData(Data=panel_3, Number=Slider(9, range=0..10), Order=Toggle(True))
dup_4 = DuplicateData(Data=panel_4, Number=Slider(9, range=0..10), Order=Toggle(True))
dup_5 = DuplicateData(Data=panel_5, Number=Slider(9, range=0..10), Order=Toggle(True))
jitter = Jitter(List=dup, Jitter=Slider(0.5, range=0..1), Seed=Slider(0, range=0..10))  # -> Values, Indices
jitter_2 = Jitter(List=dup_2, Jitter=Slider(0.5, range=0..1), Seed=2)  # -> Values, Indices
jitter_3 = Jitter(List=dup_3, Jitter=Slider(0.5, range=0..1), Seed=Slider(1, range=0..10))  # -> Values, Indices
jitter_4 = Jitter(List=dup_4, Jitter=Slider(0.5, range=0..1), Seed=Slider(2, range=0..10))  # -> Values, Indices
jitter_5 = Jitter(List=dup_5, Jitter=Slider(0.5, range=0..1), Seed=Slider(3, range=0..10))  # -> Values, Indices
xy = XYPlane(Origin=Point(0, 0, 0))
xy_2 = XYPlane(Origin=Point(0, 0, 0))
xy_3 = XYPlane(Origin=Point(0, 0, 0))
xy_4 = XYPlane(Origin=Point(0, 0, 0))
xy_5 = XYPlane(Origin=Point(0, 0, 0))
python = GhPythonScript(L=jitter.Values)  # -> nL; inputs L: list
# ---------- python: Python ----------
import rhinoscriptsyntax as rs
from Grasshopper.Kernel import GH_RuntimeMessageLevel as rel
nL = []
nL = [L[i]+sum(L[:i]) for i in range(len(L))]
# ---------- end python ----------
python_2 = GhPythonScript(L=jitter_2.Values)  # -> nL; inputs L: list; same code as python
python_3 = GhPythonScript(L=jitter_3.Values)  # -> nL; inputs L: list; same code as python
python_4 = GhPythonScript(L=jitter_4.Values)  # -> nL; inputs L: list; same code as python
python_5 = GhPythonScript(L=jitter_5.Values)  # -> nL; inputs L: list; same code as python
pt = Point(xy)
pt_2 = Point(xy_2)
Z = UnitZ(Factor=Slider(0, range=0..10))
pt_3 = Point(xy_3)
Z_2 = UnitZ(Factor=Slider(3, range=0..10))
pt_4 = Point(xy_4)
Z_3 = UnitZ(Factor=Slider(6, range=0..10))
pt_5 = Point(xy_5)
Z_4 = UnitZ(Factor=Slider(9, range=0..10))
X = UnitX(Factor=python)
X_2 = UnitX(Factor=python_2)
X_3 = UnitX(Factor=python_3)
move = Move(Geometry=pt, Motion=Z)  # -> Geometry, Transform
X_4 = UnitX(Factor=python_4)
move_2 = Move(Geometry=pt_3, Motion=Z_2)  # -> Geometry, Transform
move_3 = Move(Geometry=pt_2, Motion=Vector(0, 0, 10))  # -> Geometry, Transform
X_5 = UnitX(Factor=python_5)
move_4 = Move(Geometry=pt_4, Motion=Z_3)  # -> Geometry, Transform
move_5 = Move(Geometry=pt_5, Motion=Z_4)  # -> Geometry, Transform
move_6 = Move(Geometry=move.Geometry, Motion=X)  # -> Geometry, Transform
move_7 = Move(Geometry=pt_2, Motion=X_2)  # -> Geometry, Transform
move_8 = Move(Geometry=move_2.Geometry, Motion=X_3)  # -> Geometry, Transform
move_9 = Move(Geometry=move_4.Geometry, Motion=X_4)  # -> Geometry, Transform
move_10 = Move(Geometry=move_5.Geometry, Motion=X_5)  # -> Geometry, Transform
X_6 = UnitX(Factor=1)
X_7 = UnitX(Factor=1)
X_8 = UnitX(Factor=1)
X_9 = UnitX(Factor=1)
X_10 = UnitX(Factor=1)
neg = Negative(Value=X_6)
neg_2 = Negative(Value=X_7)
neg_3 = Negative(Value=X_8)
neg_4 = Negative(Value=X_9)
neg_5 = Negative(Value=X_10)
line = LineSDL(Start=move_6.Geometry, Direction=neg, Length=jitter.Values)
line_2 = LineSDL(Start=move_7.Geometry, Direction=neg_2, Length=jitter_2.Values)
line_3 = LineSDL(Start=move_8.Geometry, Direction=neg_3, Length=jitter_3.Values)
line_4 = LineSDL(Start=move_9.Geometry, Direction=neg_4, Length=jitter_4.Values)
line_5 = LineSDL(Start=move_10.Geometry, Direction=neg_5, Length=jitter_5.Values)
Z_5 = UnitZ(Factor=Slider(3, range=0..10))
Z_6 = UnitZ(Factor=Slider(3, range=0..10))
Z_7 = UnitZ(Factor=Slider(3, range=0..10))
Z_8 = UnitZ(Factor=Slider(3, range=0..10))
Z_9 = UnitZ(Factor=Slider(3, range=0..10))
extr = Extrude(Base=line, Direction=Z_5)
extr_2 = Extrude(Base=line_2, Direction=Z_6)
extr_3 = Extrude(Base=line_3, Direction=Z_7)
extr_4 = Extrude(Base=line_4, Direction=Z_8)
extr_5 = Extrude(Base=line_5, Direction=Z_9)
