# Grasshopper definition reaction_diffusion.gh (Grasshopper 1.0.7)
# plug-ins: Kangaroo2 Components

crv = Curve(<curve referenced from the Rhino model>)
crv_2 = Curve(<curve referenced from the Rhino model>)
crv_3 = Curve(<curve referenced from the Rhino model>)
crv_4 = Curve(<curve referenced from the Rhino model>)
crv_5 = Curve(<curve referenced from the Rhino model>)
area = Area(Geometry=crv)  # -> Area, Centroid
area_2 = Area(Geometry=crv_2)  # -> Area, Centroid
area_3 = Area(Geometry=crv_3)  # -> Area, Centroid
area_4 = Area(Geometry=crv_4)  # -> Area, Centroid
area_5 = Area(Geometry=crv_5)  # -> Area, Centroid
cir = Circle(Plane=area.Centroid, Radius=Slider(39, range=0..1000))
cir_2 = Circle(Plane=area_2.Centroid, Radius=Slider(60, range=0..1000))
cir_3 = Circle(Plane=area_3.Centroid, Radius=Slider(88, range=0..1000))
cir_4 = Circle(Plane=area_4.Centroid, Radius=Slider(120, range=0..1000))
cir_5 = Circle(Plane=area_5.Centroid, Radius=Slider(150, range=0..1000))
divide = DivideCurve(Curve=cir, Count=Slider(150, range=100..1000), Kinks=False)  # -> Points, Tangents, Parameters
divide_2 = DivideCurve(Curve=cir_2, Count=Slider(300, range=100..1000), Kinks=False)  # -> Points, Tangents, Parameters
divide_3 = DivideCurve(Curve=cir_3, Count=Slider(700, range=100..1000), Kinks=False)  # -> Points, Tangents, Parameters
divide_4 = DivideCurve(Curve=cir_4, Count=Slider(1000, range=100..1000), Kinks=False)  # -> Points, Tangents, Parameters
divide_5 = DivideCurve(Curve=cir_5, Count=Slider(1600, range=0..10000), Kinks=False)  # -> Points, Tangents, Parameters
shatter = Shatter(Curve=cir, Parameters=divide.Parameters)
shatter_2 = Shatter(Curve=cir_2, Parameters=divide_2.Parameters)
shatter_3 = Shatter(Curve=cir_3, Parameters=divide_3.Parameters)
shatter_4 = Shatter(Curve=cir_4, Parameters=divide_4.Parameters)
shatter_5 = Shatter(Curve=cir_5, Parameters=divide_5.Parameters)
len = Length(Curve=shatter)
len_2 = Length(Curve=shatter_2)
panel = Panel(shatter)
len_3 = Length(Curve=shatter_3)
panel_2 = Panel(shatter_2)
len_4 = Length(Curve=shatter_4)
panel_3 = Panel(shatter_3)
panel_4 = Panel(shatter_4)
len_5 = Length(Curve=shatter_5)
panel_5 = Panel(shatter_5)
avr = Average(Input=len)
avr_2 = Average(Input=len_2)
avr_3 = Average(Input=len_3)
avr_4 = Average(Input=len_4)
avr_5 = Average(Input=len_5)
multiplication = Multiplication(A=avr, B=Slider(10, range=0..100))
multiplication_2 = Multiplication(A=avr_2, B=Slider(10, range=0..100))
multiplication_3 = Multiplication(A=avr_3, B=Slider(10, range=0..100))
multiplication_4 = Multiplication(A=avr_4, B=Slider(10, range=0..100))
multiplication_5 = Multiplication(A=avr_5, B=Slider(10, range=0..100))
panel_6 = Panel(multiplication_4)
panel_7 = Panel(multiplication_3)
panel_8 = Panel(multiplication)
panel_9 = Panel(multiplication_5)
panel_10 = Panel(multiplication_2)
sc = SphereCollide(Points=divide.Points, Radius=multiplication, Strength=Slider(1, range=0..10))
onmesh = OnMesh(Points=divide.Points, Mesh=crv, Strength=Slider(2, range=0..10))
length_line = LengthLine(Line=shatter, Length=multiplication, Strength=Slider(10, range=0..10))
sc_2 = SphereCollide(Points=divide_2.Points, Radius=multiplication_2, Strength=Slider(1, range=0..10))
onmesh_2 = OnMesh(Points=divide_2.Points, Mesh=crv_2, Strength=Slider(2, range=0..10))
length_line_2 = LengthLine(Line=shatter_2, Length=multiplication_2, Strength=Slider(10, range=0..10))
sc_3 = SphereCollide(Points=divide_3.Points, Radius=multiplication_3, Strength=Slider(1, range=0..10))
onmesh_3 = OnMesh(Points=divide_3.Points, Mesh=crv_3, Strength=Slider(2, range=0..10))
length_line_3 = LengthLine(Line=shatter_3, Length=multiplication_3, Strength=Slider(10, range=0..10))
sc_4 = SphereCollide(Points=divide_4.Points, Radius=multiplication_4, Strength=Slider(1, range=0..10))
onmesh_4 = OnMesh(Points=divide_4.Points, Mesh=crv_4, Strength=Slider(2, range=0..10))
length_line_4 = LengthLine(Line=shatter_4, Length=multiplication_4, Strength=Slider(5, range=0..10))
sc_5 = SphereCollide(Points=divide_5.Points, Radius=multiplication_5, Strength=Slider(1, range=0..10))
onmesh_5 = OnMesh(Points=divide_5.Points, Mesh=crv_5, Strength=Slider(2, range=0..10))
length_line_5 = LengthLine(Line=shatter_5, Length=multiplication_5, Strength=Slider(5, range=0..10))
solver = Solver(GoalObjects=flatten([sc, length_line, onmesh]), Reset=Button(), Threshold=1e-15, Tolerance=0.01, On=Toggle(False))  # -> I, V, O
solver_2 = Solver(GoalObjects=flatten([sc_2, length_line_2, onmesh_2]), Reset=Button(), Threshold=1e-15, Tolerance=0.01, On=Toggle(False))  # -> I, V, O
solver_3 = Solver(GoalObjects=flatten([sc_3, length_line_3, onmesh_3]), Reset=Button(), Threshold=1e-15, Tolerance=0.01, On=Toggle(False))  # -> I, V, O
solver_4 = Solver(GoalObjects=flatten([sc_4, length_line_4, onmesh_4]), Reset=Button(), Threshold=1e-15, Tolerance=0.01, On=Toggle(False))  # -> I, V, O
solver_5 = Solver(GoalObjects=flatten([sc_5, length_line_5, onmesh_5]), Reset=Button(), Threshold=1e-15, Tolerance=0.01, On=Toggle(False))  # -> I, V, O
intcrv = Interpolate(Vertices=solver.V, Degree=3, Periodic=True, KnotStyle=1)  # -> Curve, Length, Domain
intcrv_2 = Interpolate(Vertices=solver_2.V, Degree=3, Periodic=True, KnotStyle=1)  # -> Curve, Length, Domain
intcrv_3 = Interpolate(Vertices=solver_3.V, Degree=3, Periodic=True, KnotStyle=1)  # -> Curve, Length, Domain
intcrv_4 = Interpolate(Vertices=solver_4.V, Degree=3, Periodic=True, KnotStyle=1)  # -> Curve, Length, Domain
intcrv_5 = Interpolate(Vertices=solver_5.V, Degree=3, Periodic=True, KnotStyle=1)  # -> Curve, Length, Domain
