# Grasshopper definition tile_ceiling.gh (Grasshopper 1.0.7)
# plug-ins: Pufferfish

pt = Point(<point referenced from the Rhino model>)
pt_2 = Point([<point referenced from the Rhino model> x5])
toggle = BooleanToggle(False)
xy = XYPlane(Origin=pt)
number_slider = Slider(1375, range=0..10000)
number_slider_2 = Slider(2260, range=0..10000)
number_slider_3 = Slider(579, range=0..10000)
flippln = FlipPlane(Plane=xy, FlipX=toggle, FlipY=Toggle(True), FlipZ=toggle)  # -> Flipped, R
sqgrid = Square(
    Plane=flippln.Flipped,
    Size=Slider(500, range=0..1000),
    ExtentX=Slider(20, range=0..100),
    ExtentY=Slider(8, range=0..100))  # -> flatten(Cells), Points
area = Area(Geometry=sqgrid.Cells)  # -> Area, Centroid
cp = ClosestPoint(Point=area.Centroid, Cloud=pt_2)  # -> ClosestPoint, CPIndex, Distance
ln = Line(StartPoint=area.Centroid, EndPoint=cp.ClosestPoint)
bnd = Bounds(Numbers=cp.Distance)
number_slider_4 = Slider(80, range=0..100)
panel = Panel(bnd)
smaller = SmallerThan(FirstNumber=cp.Distance, SecondNumber=number_slider_3)  # -> SmallerThan, OrEqualTo
larger = LargerThan(FirstNumber=cp.Distance, SecondNumber=number_slider_3)  # -> LargerThan, OrEqualTo
smaller_2 = SmallerThan(FirstNumber=cp.Distance, SecondNumber=number_slider)  # -> SmallerThan, OrEqualTo
larger_2 = LargerThan(FirstNumber=cp.Distance, SecondNumber=number_slider)  # -> LargerThan, OrEqualTo
smaller_3 = SmallerThan(FirstNumber=cp.Distance, SecondNumber=number_slider_2)  # -> SmallerThan, OrEqualTo
larger_3 = LargerThan(FirstNumber=cp.Distance, SecondNumber=number_slider_2)  # -> LargerThan, OrEqualTo
and = GateAnd(A=larger.OrEqualTo, B=smaller_2.OrEqualTo)
neg = Negative(Value=number_slider_4)
and_2 = GateAnd(A=larger_2.OrEqualTo, B=smaller_3.OrEqualTo)
boxrec = BoxRectangle(Rectangle=sqgrid.Cells, Height=number_slider_4)
cull = CullPattern(List=boxrec, CullPattern=smaller.OrEqualTo)
cull_2 = CullPattern(List=boxrec, CullPattern=and)
cull_3 = CullPattern(List=boxrec, CullPattern=and_2)
cull_4 = CullPattern(List=boxrec, CullPattern=larger_3.OrEqualTo)
brep = Brep(<brep referenced from the Rhino model>)
brep_2 = Brep(<brep referenced from the Rhino model>)
brep_3 = Brep(<brep referenced from the Rhino model>)
brep_4 = Brep(<brep referenced from the Rhino model>)
bbox = BoundingBox(Content=brep_3, Plane=PlaneXY(0, 0, 0))  # -> Box, Box_2
bbox_2 = BoundingBox(Content=brep, Plane=PlaneXY(0, 0, 0))  # -> Box, Box_2
bbox_3 = BoundingBox(Content=brep_2, Plane=PlaneXY(0, 0, 0))  # -> Box, Box_2
bbox_4 = BoundingBox(Content=brep_4, Plane=PlaneXY(0, 0, 0))  # -> Box, Box_2
morph = BoxMorph(Geometry=brep_4, Reference=bbox_4.Box, Target=cull)
morph_2 = BoxMorph(Geometry=brep_3, Reference=bbox.Box, Target=cull_2)
morph_3 = BoxMorph(Geometry=brep, Reference=bbox_2.Box, Target=cull_3)
morph_4 = BoxMorph(Geometry=brep_2, Reference=bbox_3.Box, Target=cull_4)
brep_5 = Brep([morph_4, morph_3, morph_2, morph])
