# Grasshopper definition floor_tile.gh (Grasshopper 1.0.7)

crv = Curve(<curve referenced from the Rhino model>)
pop2d = Populate2D(Region=crv, Count=Slider(12000, range=0..100000), Seed=1)
image = ImageSampler(
    pop2d,
    FilePath="C:\Users\Admin\Documents\guto_piso_xp\piso4.jpg",
    Filter="Value",
    Interpolate=False,
    Umax=8,
    Umin=0,
    Vmax=16,
    Vmin=0,
    Wrap=1)
sort = SortList(Keys=image, ValuesA=pop2d)  # -> Keys, ValuesA
jitter = Jitter(List=sort.ValuesA, Jitter=Slider(0.383, range=0..1), Seed=2)  # -> Values, Indices
split = SplitList(List=jitter.Values, Index=Slider(3645, range=0..10000))  # -> ListA, ListB
qt = QuadTree(Points=flatten(split.ListA), Plane=PlaneXY(0, 0, 0), Square=False, Group=Slider(3, range=0..10))  # -> Quads, Points
crv_2 = Curve(qt.Quads)
